# Grasshopper definition GraFit Network C# Example.gh (Grasshopper 1.0.7)
# plug-ins: Human, ScriptParasite

panel = Panel("C:\Users\fesmc\AppData\Roaming\Grasshopper\Libraries\GrasshopperScripts")
c_functions = CSharpScript(Reference=["C:\Users\fesmc\AppData\Roaming\Grasshopper\Libraries\Grafit\GraFit.dll", "C:\Users\fesmc\AppData\Roaming\Grasshopper\Libraries\Grafit\GraFitRhino.dll"])  # -> out, F1_CreateDualGraph, F2_CreatePrimalDirectedGraph, F3_GetShortestPath, F4_GetGeometry, F5_GetWeightMatrixAsMatrix, F6_GetWeightMatrixAsLists, F7_CalculateCentralities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
# ---------- c_functions: C# usings ----------
using Grafit;
using GrafitRhino;
using System.Linq;
# ---------- c_functions: C# ----------
    //delegate V MyDelegate<T,U,V>(T input, out U output);
    Func<List<Line>, int, int, bool, bool, bool, dynamic> f1 = f1_CreateDualGraph;
    Func<List<Line>, int, int, bool, bool, bool, List<double>, List<double>, dynamic> f2 = f2_CreatePrimalDirectedGraph;
    Func<object, int, int, bool, dynamic> f3 = f3_GetShortestPath;
    Func<object, dynamic> f4 = f4_GetGeometry;
    Func<object, int, dynamic> f5 = f5_GetWeightMatrixAsMatrix;

    Func<object, int, dynamic> f6 = f6_GetWeightMatrixAsLists;
    Func<object, List<int>, List<int>, dynamic, bool, bool, bool, int, bool, dynamic> f7 = f7_CalculateCentralities;
    Func<object, dynamic> f8 = f8_GetNextMatrix;
    Func<object, dynamic> f9 = f9_GetDisconnectedPartsDual;
    Func<object, dynamic> f10 = f10_GetDisconnectedPartsPrimal;

    Func<object, int, int, int[], double[], int, bool, bool, dynamic> f11 = f11_AlternativeShortestPaths;
    Func<object, List<int>, List<int>, dynamic, List<int>, Dictionary<int, List<int>>, int, bool, bool, dynamic> f12 = f12_CalculatePathVisibility;
    Func<List<Point3d>, List<Mesh>, List<Mesh>, List<Vector3d>, double, double, double, double, double, double, dynamic> f13 = f13_CalculateIsovist;
    Func<List<Line>, List<bool>, List<bool>, List<double>, List<double>, int, int, bool, dynamic> f14 = f14_CognitiveTemporalGraph;

    F1_CreateDualGraph = f1;
    F2_CreatePrimalDirectedGraph = f2;
    F3_GetShortestPath = f3;
    F4_GetGeometry = f4;
    F5_GetWeightMatrixAsMatrix = f5;
    F6_GetWeightMatrixAsLists = f6;
    F7_CalculateCentralities = f7;
    F8_GetNextMatrix = f8;
    F9_GetDisconnectedPartsDual = f9;
    F10_GetDisconnectedPartsPrimal = f10;
    F11_AlternativeShortestPaths = f11;
    F12_CalculatePathVisibility = f12;
    F13_Isovist = f13;
    F14_CognitiveTemporalGraph = f14;
# ---------- c_functions: C# additional code ----------
  //----------------------------------------------------------------------------------------------
  public static dynamic f1_CreateDualGraph(List<Line> LineGeometry, int WeightMatrixIdxMain, int WeightMatrixIdxFilter, bool CalculateAllMatrices,
    bool UseFilterMatrix, bool GPU)
  {

    CPrimalDirectedGraph<Point3d, Line> primalGraph;
    CDualUndirectedGraph<Point3d, Line> dualGraph;

    //Create Primal Graph from which Dual Graph will be created
    {
      double[] edgeLengths;

      var graphElements = GeometryToGraphElements<Point3d, Line>.GetNodesAndEdgesFromLines(LineGeometry.Select(s => new CWLine(s)).ToArray(),
        out edgeLengths);

      primalGraph = new CPrimalDirectedGraph<Point3d, Line>(graphElements);
      primalGraph.AddWeightMatrix(edgeLengths); // index 0
      primalGraph.AddEmptyWeightMatrix(); // index 1 - angles

      for (int i = 0; i < primalGraph.UndirectedEdges.Count; i++)
      {
        var n1 = primalGraph.UndirectedEdges[i][0]; // start node of edge #i
        var n2 = primalGraph.UndirectedEdges[i][1]; // end node of edge #i

        double weight_1 = 0.0; // angle of a single edge is 0.0 deg
        int weight_matrix_id = 1;

        primalGraph.SetWeightMatrixAndEdgeValue(weight_1, n1, n2, weight_matrix_id); // forward direction
        primalGraph.SetWeightMatrixAndEdgeValue(weight_1, n2, n1, weight_matrix_id); // backward direction

      }
    }


    //Create Dual Graph
    {
      double[] edgeAngles;
      double[] edgeLengths;

      var graphElements = GeometryToGraphElements<Point3d, Line>.GetDualNodesAndEdgesFromPrimalGraph(primalGraph,
        out edgeLengths, out edgeAngles);

      dualGraph = new CDualUndirectedGraph<Point3d, Line>(primalGraph, graphElements);

      //The order of dual graph weight matrices must be the same as in primal graph
      //First, add dual lenghts
      dualGraph.AddWeightMatrix(edgeLengths); // index 0
      //Second, add dual angles
      dualGraph.AddWeightMatrix(edgeAngles);  // index 1


      //Example of traversing dual edges in order to customize weights
      //dualGraph.AddEmptyWeightMatrix(); // index 2 - some other weight
      //foreach (var edge in dualGraph.UndirectedEdges)
      //{
      //  var prim_edge_id_0 = edge[0];
      //  var prim_edge_id_1 = edge[1];

      //  var e0n1 = dualGraph.Nodes[prim_edge_id_0].PrimId1; // primal node from of edge 0
      //  var e0n2 = dualGraph.Nodes[prim_edge_id_0].PrimId2; // primal node to of edge 0

      //  var e1n1 = dualGraph.Nodes[prim_edge_id_1].PrimId1;   // primal node from of edge 1
      //  var e1n2 = dualGraph.Nodes[prim_edge_id_1].PrimId2;   // primal node to of edge 2

      //var some_weight = 0;
      //var weight_matrix_index = 2;
      //dualGraph.SetWeightMatrixValue(some_weight, prim_edge_id_0, prim_edge_id_1, weight_matrix_index);
      //}

      if (UseFilterMatrix)
        dualGraph.APShortestPathsByManyWeights(WeightMatrixIdxMain, WeightMatrixIdxFilter, GPU);
      else
        dualGraph.APShortestPathsByOneWeight(WeightMatrixIdxMain, GPU);
    }


    //if graph has more than 1 weight matrix, then there is an option to calculate distances along
    //shortest paths according to all other weights
    if (CalculateAllMatrices)
    {
      //select which weights are needed to measure shortest paths
      //by default all other matrices which are not the main are selected
      var allIds = dualGraph.weightMatrices.Select((s, i) => i);
      var otherMatricesIds = allIds.Select((s, i) => i).Where(s => s != WeightMatrixIdxMain).ToArray();
      dualGraph.FillWeightMatrixBySPRestore(otherMatricesIds, GPU);
    }

    return new dynamic[1] { dualGraph }; ;
  }

  //----------------------------------------------------------------------------------------------
  public static dynamic f2_CreatePrimalDirectedGraph(List<Line> LineGeometry, int WeightMatrixIdxMain, int WeightMatrixIdxFilter, bool CalculateAllMatrices,
    bool UseFilterMatrix, bool GPU, List<double> weights1, List<double> weights2)
  {

    double[] edgeLengths;

    var graphElements = GeometryToGraphElements<Point3d, Line>.GetNodesAndEdgesFromLines(LineGeometry.Select(s => new CWLine(s)).ToArray(),
      out edgeLengths);



    var graph = new CPrimalDirectedGraph<Point3d, Line>(graphElements);


    graph.AddWeightMatrix(edgeLengths); // index 0
    graph.AddEmptyWeightMatrix(double.MaxValue); // index 1

    for (int i = 0; i < graph.UndirectedEdges.Count; i++)
    {
      var n1 = graph.UndirectedEdges[i][0]; // start node of edge #i
      var n2 = graph.UndirectedEdges[i][1]; // end node of edge #i

      int weight_matrix_id = 1;

      graph.SetWeightMatrixValue(weights1[i], n1, n2, weight_matrix_id); // forward direction
      graph.SetWeightMatrixValue(weights2[i], n2, n1, weight_matrix_id); // backward direction

    }

    if (UseFilterMatrix)
      graph.APShortestPathsByManyWeights(WeightMatrixIdxMain, WeightMatrixIdxFilter, GPU);
    else
      graph.APShortestPathsByOneWeight(WeightMatrixIdxMain, GPU);



    //if graph has more than 1 weight matrix, then there is an option to calculate distances along
    //shortest paths according to all other weights
    if (CalculateAllMatrices)
    {
      //select which weights are needed to measure shortest paths
      //by default all other matrices which are not the main are selected
      var allIds = graph.weightMatrices.Select((s, i) => i);
      var otherMatricesIds = allIds.Select((s, i) => i).Where(s => s != WeightMatrixIdxMain).ToArray();
      graph.FillWeightMatrixBySPRestore(otherMatricesIds, GPU);
    }

    return graph;
  }
  //----------------------------------------------------------------------------------------------
  public static dynamic[] f3_GetShortestPath(object Graph, int Origin, int Destination, bool UseDirectedEdges)
  {
    var graph = Graph as AGraph;

    List<int> PathNodesIds;
    List<int> PathEdgesIds;

    //Get shortest path as node-points only
    //graph.GetShortestPathNodeIds(Origin, Destination);

    //Get shortest path as node-points and edge-lines
    graph.GetShortestPathNodeAndEdgeIds(Origin, Destination, UseDirectedEdges, out PathNodesIds, out PathEdgesIds);

    var wmc = graph.weightMatrices.Count();

    var distances = new List<double>();
    for (int i = 0; i < wmc; i++)
    {
      distances.Add(graph.GetShortestPathDistance(Origin, Destination, i));
    }



    return new dynamic[3] { PathNodesIds, PathEdgesIds, distances };

  }
  //----------------------------------------------------------------------------------------------
  public static dynamic[] f4_GetGeometry(object Graph)
  {
    var graph = Graph as ISpatialGraph<AWPoint<Point3d>, AWLine<Point3d, Line>, Point3d, Line>;

    if (Graph is CDualUndirectedGraph<Point3d, Line>)
    {
      var graph_dual = Graph as CDualUndirectedGraph<Point3d, Line>;
      graph = graph_dual.PrimalDirectedGraph;
    }

    var NodeAsPoints = graph.NodesGeometryList.Select(s => s.Internal);
    var EdgesDirected = graph.GenerateDirectedEdgeGeometry(CWLine.LineFromPoints).Select(s => s.Internal);
    var EdgesUndirected = graph.GenerateUndirectedEdgeGeometry(CWLine.LineFromPoints).Select(s => s.Internal);

    return new dynamic[3] { NodeAsPoints, EdgesDirected, EdgesUndirected };
  }

  //----------------------------------------------------------------------------------------------
  public static dynamic f5_GetWeightMatrixAsMatrix(object Graph, int WeightMatrixIndex)
  {
    // Get Weight Matrix As Rhino Matrix Object
    var n = (Graph as IMeasurableGraph).NodesCountMeasure;
    var dm = (Graph as AGraph).GetWeigthMatrixById(WeightMatrixIndex);

    return GrafitRhinoUtils.Get1DDoubleArrayAsMatrix(dm);
  }

  //----------------------------------------------------------------------------------------------
  public static dynamic f6_GetWeightMatrixAsLists(object Graph, int WeightMatrixIndex)
  {
    var n = (Graph as IMeasurableGraph).NodesCountMeasure;
    var dm = (Graph as AGraph).GetWeigthMatrixById(WeightMatrixIndex);

    return GrafitRhinoUtils.Get1DDoubleArrayAsListList(dm);
  }
  //----------------------------------------------------------------------------------------------
  public static dynamic[] f7_CalculateCentralities(object Graph, List<int> From, List<int> To, dynamic ODWeightMatrixReduced,
  bool Directed, bool CalculateBC, bool CalculateCC, int CCWeightMatrix, bool GPU = true)
  {
    var graph = Graph as IMeasurableGraph;
    var n = graph.NodesCountMeasure;

    var odRhinoMatrix = ODWeightMatrixReduced as Matrix;

    var odwm = new double[n * n]; // filled with 0s

    for (int i = 0; i < From.Count; i++)
      for (int j = 0; j < To.Count; j++)
      {
        odwm[From[i] * n + To[j]] = odRhinoMatrix[i, j];
      }

    var measurement = new CMeasure(graph);
    measurement.UseDirectedEdges = Directed;

    double[] CCN = null;
    double[] CCE = null;
    double[] BCN = null;
    double[] BCE = null;

    if (CalculateBC)
    {
      measurement.CalculateBC(odwm, GPU);


      BCN = measurement.BCNodes;
      BCE = measurement.BCEdges;
    }

    if (CalculateCC)
    {
      measurement.CalculateCC(odwm, CCWeightMatrix, GPU);
      CCN = measurement.CCNodes;
      CCE = measurement.CCEdges;
    }

    return new dynamic[4] { BCN, BCE, CCN, CCE };

  }

  public static dynamic f8_GetNextMatrix(object Graph)
  {
    var graph = Graph as IMeasurableGraph;

    if (graph.IsDual)
      return (Graph as CDualUndirectedGraph<Point3d, Line>).PrimalDirectedGraph.NextMatrix;
    else
      return graph.NextMatrix;
  }

  public static dynamic f9_GetDisconnectedPartsDual(object Graph)
  {
    var graph = Graph as CDualUndirectedGraph<Point3d, Line>;

    var undirEdgesCount = graph.PrimalDirectedGraph.UndirectedEdges.Count;

    var undirEdgesDegree = new int[undirEdgesCount];

    for (int i = 0; i < undirEdgesCount; i++)
    {
      for (int j = 0; j < undirEdgesCount; j++)
      {
        if (i == j) continue;

        if (graph.IsAdjacent(i, j)) undirEdgesDegree[i]++;
        if (graph.IsAdjacent(i, j + undirEdgesCount)) undirEdgesDegree[i]++;
        if (graph.IsAdjacent(i + undirEdgesCount, j + undirEdgesCount)) undirEdgesDegree[i]++;
        if (graph.IsAdjacent(i + undirEdgesCount, j)) undirEdgesDegree[i]++;
      }
    }

    return undirEdgesDegree;
  }

  public static dynamic f10_GetDisconnectedPartsPrimal(object Graph)
  {
    var graph = Graph as CPrimalDirectedGraph<Point3d, Line>;


    List<List<int>> subgraphs = new List<List<int>>();
    bool[] visited = new bool[graph.NodesCount];

    for (int i = 0; i < graph.NodesCount; i++)
    {
      if (!visited[i])
      {
        List<int> subgraph = new List<int>();
        DFS(i, graph.NodesCount, graph.GetWeigthMatrixById(0), visited, subgraph);
        subgraphs.Add(subgraph);
      }
    }

    return subgraphs;
  }

  public static dynamic f11_AlternativeShortestPaths(object Graph, int StartNodeId, int FinishNodeId,
    int[] WeightsIds,
    double[] WeightsTolerance,
    int Limit = 100,
    bool ToleranceOnly = true,
    bool SaveIndividualPaths = false)
  {

    var graph = Graph as AGraph;
    List<List<int>> resultNodes = new List<List<int>>();
    List<List<int>> resultEdges = new List<List<int>>();


    graph.AlternativeShortestPaths(StartNodeId, FinishNodeId, WeightsIds, WeightsTolerance, out resultNodes,
      out resultEdges, Limit, ToleranceOnly, SaveIndividualPaths);



    return new dynamic[2] { resultNodes, resultEdges };
  }

  private static void DFS(int node, int size, double[] distances, bool[] visited, List<int> subgraph)
  {
    visited[node] = true;
    subgraph.Add(node);

    for (int i = 0; i < size; i++)
    {
      if (!visited[i] && distances[node * size + i] != double.PositiveInfinity)
      {
        DFS(i, size, distances, visited, subgraph);
      }
    }
  }

  //----------------------------------------------------------------------------------------------
  public static dynamic[] f12_CalculatePathVisibility(object Graph, List<int> From, List<int> To, dynamic ODWeightMatrixReduced,
  List<int> VantagePointToBreps, Dictionary<int, List<int>> EdgeToVantagePoints, int BrepsCount,
  bool Directed, bool GPU = true)
  {
    var graph = Graph as IMeasurableGraph;
    var n = graph.NodesCountMeasure;

    var odRhinoMatrix = ODWeightMatrixReduced as Matrix;

    var odwm = new double[n * n]; // filled with 0s

    for (int i = 0; i < From.Count; i++)
      for (int j = 0; j < To.Count; j++)
      {
        odwm[From[i] * n + To[j]] = odRhinoMatrix[i, j];
      }


    var measurement = new CMeasure(graph);
    measurement.UseDirectedEdges = Directed;

    var pathVisibility = measurement.CalculateBCVisibility(odwm, VantagePointToBreps.ToArray(), EdgeToVantagePoints, BrepsCount);



    return new dynamic[1] { pathVisibility };

  }

  //----------------------------------------------------------------------------------------------
  public static dynamic[] f13_CalculateIsovist(List<Point3d> vantagePoints,
    List<Mesh> obstacleSurfaces,
    List<Mesh> groundSurfaces,
    List<Vector3d> viewDirection, double viewRange, double horizontalViewAngle,
    double verticalViewAngle,
    double horizontalPrecision, double verticalPrecision, double verticalOffset)
  {

    var isovist = new CIsovist(vantagePoints,
      obstacleSurfaces,
      groundSurfaces,
      viewDirection, viewRange, horizontalViewAngle,
      verticalViewAngle,
      horizontalPrecision, verticalPrecision, verticalOffset);

    return new dynamic[3] { isovist.hits, isovist.surfaceToRaysList, isovist.NumberOfRaysPerPoint };
  }

  //----------------------------------------------------------------------------------------------
  public static dynamic f14_CognitiveTemporalGraph(List<Line> LineGeometry, List<bool> EdgeIsLink, List<bool> EdgeIsActivityNodeLink,
    List<double> TimeWeightsIn, List<double> TimeWeightsOut,
    int WeightMatrixIdx, int RelativeWeightMatrixIdx, bool GPU)
  {

    CPrimalDirectedGraph<Point3d, Line> primalGraph = null;
    CDualUndirectedGraph<Point3d, Line> dualGraph = null;

    {
      double[] edgeLengths;

      var graphElements = GeometryToGraphElements<Point3d, Line>.GetNodesAndEdgesFromLines(LineGeometry.Select(s => new CWLine(s)).ToArray(),
        out edgeLengths);



      primalGraph = new CPrimalDirectedGraph<Point3d, Line>(graphElements);
      primalGraph.AddWeightMatrix(edgeLengths); // index 0 - metric
      primalGraph.AddEmptyWeightMatrix();       // index 1 - angles
      primalGraph.AddEmptyWeightMatrix(double.MaxValue);       // index 2 - steps
      primalGraph.AddEmptyWeightMatrix(double.MaxValue);       // index 3 - time

      for (int i = 0; i < primalGraph.UndirectedEdges.Count; i++)
      {
        var n1 = primalGraph.UndirectedEdges[i][0];
        var n2 = primalGraph.UndirectedEdges[i][1];

        primalGraph.SetWeightMatrixAndEdgeValue(0.0, n1, n2, 1); // 1 - angles
        primalGraph.SetWeightMatrixAndEdgeValue(0.0, n2, n1, 1); // 1 - angles

        primalGraph.SetWeightMatrixAndEdgeValue(0.0, n1, n2, 2); // 2 - steps
        primalGraph.SetWeightMatrixAndEdgeValue(0.0, n2, n1, 2); // 2 - steps

        primalGraph.SetWeightMatrixAndEdgeValue(TimeWeightsIn[i], n1, n2, 3); // 3 - time
        primalGraph.SetWeightMatrixAndEdgeValue(TimeWeightsOut[i], n2, n1, 3); // 3 - time

      }
    }

    {
      double[] edgeAngles;
      double[] edgeLengths;

      var graphElements = GeometryToGraphElements<Point3d, Line>.GetDualNodesAndEdgesFromPrimalGraph(primalGraph,
        out edgeLengths, out edgeAngles);

      dualGraph = new CDualUndirectedGraph<Point3d, Line>(primalGraph, graphElements);

      dualGraph.AddWeightMatrix(edgeLengths); // index 0 - metric
      dualGraph.AddWeightMatrix(edgeAngles);  // index 1 - angles
      dualGraph.AddEmptyWeightMatrix(double.MaxValue);       // index 2 - steps
      dualGraph.AddEmptyWeightMatrix(double.MaxValue);       // index 3 - time





      for (int i = 0; i < dualGraph.UndirectedEdges.Count; i++)
      {


        var edge = dualGraph.UndirectedEdges[i];
        var primDirEdgeId_0 = edge[0];
        var primDirEdgeId_1 = edge[1];

        var e0n1 = dualGraph.Nodes[primDirEdgeId_0].PrimId1; // primal node from of edge 0
        var e0n2 = dualGraph.Nodes[primDirEdgeId_0].PrimId2; // primal node to of edge 0

        var e1n1 = dualGraph.Nodes[primDirEdgeId_1].PrimId1;   // primal node from of edge 1
        var e1n2 = dualGraph.Nodes[primDirEdgeId_1].PrimId2;   // primal node to of edge 2

        //edge to opposite itself
        if (e0n1 == e1n2)
        {
          // index 2 - steps
          dualGraph.SetWeightMatrixAndEdgeValue(double.PositiveInfinity, primDirEdgeId_0, primDirEdgeId_1, 2);
          dualGraph.SetWeightMatrixAndEdgeValue(double.PositiveInfinity, primalGraph.GetOppositeEdgeId(primDirEdgeId_1), primalGraph.GetOppositeEdgeId(primDirEdgeId_0), 2);

          // index 3 - time
          //primalGraph.GetEdgeValue1st(primDirEdgeId_0, 3) + primalGraph.GetEdgeValue1st(primDirEdgeId_1, 3)
          dualGraph.SetWeightMatrixAndEdgeValue(double.PositiveInfinity, primDirEdgeId_0, primDirEdgeId_1, 3);
          dualGraph.SetWeightMatrixAndEdgeValue(double.PositiveInfinity, primalGraph.GetOppositeEdgeId(primDirEdgeId_1), primalGraph.GetOppositeEdgeId(primDirEdgeId_0), 3);
          continue;
        }


        bool isEdgeLink_0 = EdgeIsLink[primalGraph.GetUndirectedEdgeId(primDirEdgeId_0)];
        bool isEdgeLink_1 = EdgeIsLink[primalGraph.GetUndirectedEdgeId(primDirEdgeId_1)];

        bool iEdgeIsActivityNodeLink_0 = EdgeIsActivityNodeLink[primalGraph.GetUndirectedEdgeId(primDirEdgeId_0)];
        bool iEdgeIsActivityNodeLink_1 = EdgeIsActivityNodeLink[primalGraph.GetUndirectedEdgeId(primDirEdgeId_1)];

        //0 = normal segment
        //1 = modal link
        //2 = activity node link

        // start
        int LinkType_0 = 0;

        if (isEdgeLink_0)
          LinkType_0 = 1;

        if (iEdgeIsActivityNodeLink_0)
          LinkType_0 = 2;

        //end
        int LinkType_1 = 0;

        if (isEdgeLink_1)
          LinkType_1 = 1;

        if (iEdgeIsActivityNodeLink_1)
          LinkType_1 = 2;

        //tolerance = 0.000001;
        double dualStepWeight = 0.00000001;

        //step between two defaul segments
        ///penalty based on the angular deviation between the segments and presence of crossings
        ///if there is no crossing the penalty is 0. if there is crossing and we have to turn more than 30 degree from original direction the penalty is 1
        if (LinkType_0 == 0 & LinkType_1 == 0)
        {
          var angle = dualGraph.GetEdgeValue(i, 1);
          if (angle > 30.0 && primalGraph.Nodes[e0n2].OutNeighbourEdges.Count > 2)
          {
            dualStepWeight = 1.0;
          }
        }

        //step between default segment and activity node link
        /// penalty is 1000 (an link penalty to avoid internal shortcuts) + 1 (to cound for one decision)
        if ((LinkType_0 == 2 & LinkType_1 == 0) | (LinkType_1 == 2 & LinkType_0 == 0))
        {
          dualStepWeight = 1 + 1000;
        }

        //step between activity node and modal link
        /// penalty is 0.5 (modal penalty is always in entry exit pairs, we use 0.5 so that the full modal change take 1 decision) + 1000 (activity node penalty)
        if ((LinkType_0 == 2 & LinkType_1 == 1) | (LinkType_1 == 2 & LinkType_0 == 1))
        {
          dualStepWeight = 0.5 + 1000;
        }

        //step between activity node link and activity node link
        /// penalty is 1000 (activity node penalty)
        if ((LinkType_0 == 2 & LinkType_1 == 2))
        {
          dualStepWeight = 1000 + 1000;
        }

        //step between modal link and modal link
        /// penalty is 1, this is used whne traveling through the internal network
        if ((LinkType_0 == 1 & LinkType_1 == 1))
        {
          dualStepWeight = 1;
        }

        //step between modal link and defaul segment
        // penalty is 0.5 (modal penalty is always in entry exit pairs, we use 0.5 so that the full modal change take 1 decision)
        if ((LinkType_0 == 1 & LinkType_1 == 0) | (LinkType_1 == 1 & LinkType_0 == 0))
        {
          dualStepWeight = 0.5;
        }


        dualGraph.SetWeightMatrixAndEdgeValue(dualStepWeight, primDirEdgeId_0, primDirEdgeId_1, 2); // index 2 - steps
        dualGraph.SetWeightMatrixAndEdgeValue(dualStepWeight, primalGraph.GetOppositeEdgeId(primDirEdgeId_1), primalGraph.GetOppositeEdgeId(primDirEdgeId_0), 2);

        var dualEdgeTimeWeight1 = (primalGraph.GetEdgeValue(primDirEdgeId_0, 3) + primalGraph.GetEdgeValue(primDirEdgeId_1, 3)) / 2.0;
        var dualEdgeTimeWeight2 = (primalGraph.GetEdgeValue(primalGraph.GetOppositeEdgeId(primDirEdgeId_1), 3) + primalGraph.GetEdgeValue(primalGraph.GetOppositeEdgeId(primDirEdgeId_0), 3)) / 2.0;

        dualGraph.SetWeightMatrixAndEdgeValue(dualEdgeTimeWeight1, primDirEdgeId_0, primDirEdgeId_1, 3); // index 3 - time
        dualGraph.SetWeightMatrixAndEdgeValue(dualEdgeTimeWeight2, primalGraph.GetOppositeEdgeId(primDirEdgeId_1), primalGraph.GetOppositeEdgeId(primDirEdgeId_0), 3);

      }
       

      dualGraph.APShortestPathsByManyWeights(WeightMatrixIdx, RelativeWeightMatrixIdx, GPU, 0.0000000001);
      //dualGraph.APShortestPathsByOneWeight(WeightMatrixIdx, GPU);

      //Calculate all other Weight Matrices, which are not WeightMatrixIdx
      var allIds = dualGraph.weightMatrices.Select((s, i) => i);

      {
        var otherMatricesIds = allIds.Select((s, i) => i).Where(s => s != WeightMatrixIdx).ToArray();
        dualGraph.FillWeightMatrixBySPRestore(otherMatricesIds, GPU);
      }


    }
    return new dynamic[1] { dualGraph };
  }
# ---------- end c_functions ----------
scriptpar = ScriptParasite(Enable=Toggle(False), Folder=panel)

# ---- group: Test Network Geometry
crv_random_network_s = Curve([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])
crv_random_network_l = Curve([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])
crv_regular_grid = Curve([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])

# ----
explode = Explode(Curve=crv_random_network_l, Recursive=True)  # -> flatten(Segments), Vertices
line = Line(flatten(explode.Segments))
panel_2 = Panel("""0.5
0.1""")
# For example, set all additional edge weights as 1. Shortest path then will reflect number of segments in path. This weights are stored as WeightMatrix with index #1
lng = ListLength(List=line)
toggle_calculateallmatrices = BooleanToggle(False)
toggle_usefiltermatrix = BooleanToggle(False)
toggle_gpu = BooleanToggle(False)
weight_matrix_id = Panel("1")
weight_filter_matrix_id = Panel("0")
repeat = RepeatData(Data=" 1", Length=lng)
data = Data(repeat)
c_f1_dual_graph = CSharpScript(
    LineGeometry=line,
    f=c_functions.F1_CreateDualGraph,
    WeightMatrixIndexMain=weight_matrix_id,
    WeightMatrixIndexFilter=weight_filter_matrix_id,
    CalculateAllMatrices=toggle_calculateallmatrices,
    UseFilterMatrix=toggle_usefiltermatrix,
    GPU=toggle_gpu)  # -> out, DualGraph; inputs LineGeometry: list of Line, WeightMatrixIndexMain: Int32, WeightMatrixIndexFilter: Int32, CalculateAllMatrices: Boolean, UseFilterMatrix: Boolean, GPU: Boolean
# ---------- c_f1_dual_graph: C# usings ----------
using System.Linq;
# ---------- c_f1_dual_graph: C# ----------
    var F = f as  Func<List<Line>, int, int, bool, bool, bool, dynamic >;

    var result = F(LineGeometry, WeightMatrixIndexMain, WeightMatrixIndexFilter, CalculateAllMatrices, UseFilterMatrix, GPU);
    DualGraph = result[0];

    return;
# ---------- end c_f1_dual_graph ----------
c_f2_primal_directed_graph = CSharpScript(
    LineGeometry=line,
    f=c_functions.F2_CreatePrimalDirectedGraph,
    EdgeWeightsForward=data,
    EdgeWeightsBackward=data,
    WeightMatrixIdx=weight_matrix_id,
    WeightMatrixIndexFilter=weight_filter_matrix_id,
    CalculateAllMatrices=toggle_calculateallmatrices,
    UseFilterMatrix=toggle_usefiltermatrix,
    GPU=toggle_gpu)  # -> out, PrimalDirGraph; inputs LineGeometry: list of Line, EdgeWeightsForward: list of Double, EdgeWeightsBackward: list of Double, WeightMatrixIdx: Int32, WeightMatrixIndexFilter: Int32, CalculateAllMatrices: Boolean, UseFilterMatrix: Boolean, GPU: Boolean
# ---------- c_f2_primal_directed_graph: C# ----------
    var F = f as  Func < List < Line>, int, int, bool, bool, bool, List < double>, List < double>, dynamic >;

    PrimalDirGraph = F(LineGeometry, WeightMatrixIdx, WeightMatrixIndexFilter, CalculateAllMatrices, UseFilterMatrix, GPU, EdgeWeightsForward, EdgeWeightsBackward);

    return;
# ---------- end c_f2_primal_directed_graph ----------
brep_obstacles = Brep(flatten([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]))
srf_ground = Surface(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)
origin_ids = Panel("""0
1
6
11""")
destination_ids = Panel("""3
5
7
34""")
agraph = Data(c_f2_primal_directed_graph.PrimalDirGraph)
vertical_angle_offset = Slider(0, range=0..100)
horizontal_precision = Slider(10, range=0..10)
vertical_precision = Slider(10, range=0..10)
toggle_out_hit_points = BooleanToggle(False)
mesh = MeshBrep(
    Brep=brep_obstacles,
    Settings={GridMaxCount=0, GridMinCount=16, JaggedSeams=False, MaxEdgeLength=0, MinEdgeLength=0.0001, MinTolerance=0, Refine=True, RefineAngle=0, RelativeTolerance=0.65, SimplePlanes=True, Tolerance=0})
mesh_2 = MeshBrep(
    Brep=srf_ground,
    Settings={GridMaxCount=0, GridMinCount=16, JaggedSeams=False, MaxEdgeLength=0, MinEdgeLength=0.0001, MinTolerance=0, Refine=True, RefineAngle=0, RelativeTolerance=0.65, SimplePlanes=True, Tolerance=0})
c_f5_get_weight_matrix_as_matrix_pairwic = CSharpScript(
    Graph=agraph,
    f=c_functions.F5_GetWeightMatrixAsMatrix,
    From=origin_ids,
    To=destination_ids,
    WeightMatrixIndex=weight_matrix_id)  # -> out, DistanceMatrix, A; "C# F5 Get Weight Matrix As Matrix (Pairwice)"; inputs From: list of Int32, To: list of Int32, WeightMatrixIndex: Int32
# ---------- c_f5_get_weight_matrix_as_matrix_pairwic: C# usings ----------
//using Grafit;
//using GrafitRhino;
using System.Linq;
# ---------- c_f5_get_weight_matrix_as_matrix_pairwic: C# ----------
    var F = f as   Func<object, int, dynamic>;

    var result = F(Graph, WeightMatrixIndex);

    int FromN = From.Count;
    int ToN = To.Count; 

    var reducedODMatrix = new Matrix(FromN, ToN);

    for(int i = 0; i < FromN; i++)
    {   
        reducedODMatrix[i, i] = 1;//weight;
    } 


    DistanceMatrix = reducedODMatrix;
    A = result;

    return;
# ---------- end c_f5_get_weight_matrix_as_matrix_pairwic ----------
c_f5_get_weight_matrix_as_matrix = CSharpScript(
    Graph=agraph,
    f=c_functions.F5_GetWeightMatrixAsMatrix,
    From=origin_ids,
    To=destination_ids,
    WeightMatrixIndex=weight_matrix_id)  # -> out, DistanceMatrix, A; inputs From: list of Int32, To: list of Int32, WeightMatrixIndex: Int32
# ---------- c_f5_get_weight_matrix_as_matrix: C# ----------
    var F = f as   Func<object, int, dynamic>;

    var result = F(Graph, WeightMatrixIndex);

    int FromN = From.Count;
    int ToN = To.Count;


    var reducedODMatrix = new Matrix(FromN, ToN);

    for(int i = 0; i < FromN; i++)
    {
      for(int j = 0; j < ToN; j++)
      {
        var weight = result[From[i], To[j]];
        reducedODMatrix[i, j] = weight;
      }

    }

    DistanceMatrix = reducedODMatrix;
    A = result;

    return;
# ---------- end c_f5_get_weight_matrix_as_matrix ----------
c_f4_generate_geometry = CSharpScript(Graph=agraph, f=c_functions.F4_GetGeometry)  # -> out, NodeAsPoints, EdgesDirected, EdgesUndirected
# ---------- c_f4_generate_geometry: C# ----------
    var F = f as   Func<object, dynamic>;

    var result = F(Graph); 

    NodeAsPoints = result[0];
    EdgesDirected = result[1];
    EdgesUndirected = result[2];

    return;

    /*
    var graph = Graph as ISpatialGraph<AWPoint<Point3d>, AWLine<Point3d, Line>, Point3d, Line>;

    if(Graph is CDualUndirectedGraph<Point3d, Line>)
    {
      var graph_dual = Graph as CDualUndirectedGraph<Point3d, Line>;
      graph = graph_dual.PrimalDirectedGraph;
    }

    NodeAsPoints = graph.NodesGeometryList.Select(s => s.Internal);
    EdgesDirected = graph.GenerateDirectedEdgeGeometry(CWLine.LineFromPoints).Select(s => s.Internal);
    EdgesUndirected = graph.GenerateUndirectedEdgeGeometry(CWLine.LineFromPoints).Select(s => s.Internal);
 */
# ---------- c_f4_generate_geometry: C# additional code ----------
  public delegate TResult CFunc<in T1, T2, T3, T4, out TResult>(T1 input, out T2 output1, out T3 output2, out T4 output3);
# ---------- end c_f4_generate_geometry ----------
edgeundirectedlines = Data(c_f4_generate_geometry.EdgesUndirected)
undiredges = Line(edgeundirectedlines)
# Each edge here have 2 points. This tree structure is converted to a flat list of points and to a tree where each edge index corresponds to flat point index
eval = EvaluateCurve(Curve=graft(undiredges), Parameter=panel_2)  # -> Point, Tangent, Angle
move = Move(Geometry=eval.Point, Motion="{0, 0, 1}")  # -> simplify(Geometry), Transform
c_create_vp_per_edge_tree = CSharpScript(GeometryTree=move.Geometry)  # -> out, FlatPointsList, IndexTree; inputs GeometryTree: tree of Point3d
# ---------- c_create_vp_per_edge_tree: C# ----------
    var resultIndex = new DataTree<int>();
    var resultPoints = new List<Point3d>();

    int flatIndex = 0;

    for(int i = 0; i < GeometryTree.BranchCount; i++)
    {
      foreach(var item in GeometryTree.Branches[i])
      {
        resultIndex.Add(flatIndex, new GH_Path(i));
        resultPoints.Add(item);
        flatIndex++;
      }
    }

    FlatPointsList = resultPoints;
    IndexTree = resultIndex;
# ---------- end c_create_vp_per_edge_tree ----------
vantagepoints = Point(c_create_vp_per_edge_tree.FlatPointsList)

vec = VectorXYZ(XComponent=0, YComponent="-1", ZComponent=0)  # -> Vector, Length
lng_2 = ListLength(List=vantagepoints)
repeat_2 = RepeatData(Data=vec.Vector, Length=lng_2)

c_f13_isovist_3d_gpu = CSharpScript(
    f=c_functions.F13_Isovist,
    VP=vantagepoints,
    OS=mesh,
    GS=mesh_2,
    VD=repeat_2,
    VR=Slider(1000, range=0..1000),
    HVA=Slider(360, range=0..1000),
    VVA=Slider(90, range=0..100),
    HPr=horizontal_precision,
    VPr=vertical_precision,
    VAO=vertical_angle_offset,
    OHP=toggle_out_hit_points)  # -> out, HitPoints, flatten(MeshIdsPerRay), NumberOfRays; inputs VP: list of Point3d, OS: list of Mesh, GS: list of Mesh, VD: list of Vector3d, VR: Double, HVA: Double, VVA: Double, HPr: Double, VPr: Double, VAO: Double, OHP: Boolean
# ---------- c_f13_isovist_3d_gpu: C# ----------
    var F = f as Func < List < Point3d> , List < Mesh> , List < Mesh> , List < Vector3d> , double , double , double , double , double , double, dynamic>;

    var result = F(VP, OS, GS, VD, VR, HVA, VVA, HPr, VPr, VAO);

    if(OHP)
      HitPoints = result[0];

    MeshIdsPerRay = result[1];
    NumberOfRays = result[2];
# ---------- end c_f13_isovist_3d_gpu ----------
edgedirectedlines = Data(c_f4_generate_geometry.EdgesDirected)
nodepoints = Data(c_f4_generate_geometry.NodeAsPoints)
stop_searching_at_this_number_of_paths = Panel("800")
destination = Point(Point(7.571157764, 63.56158008, 0))
origin = Point(Point(-37.08688782, 11.53385668, 0))

# ---- group: Get Rays for Vantage Point
vantage_point_id = Panel("5")
c_script = CSharpScript(VPID=vantage_point_id, RaysCountPerPoint=c_f13_isovist_3d_gpu.NumberOfRays, HitPoints=c_f13_isovist_3d_gpu.HitPoints)  # -> out, A; inputs VPID: Int32, RaysCountPerPoint: Int32, HitPoints: list
# ---------- c_script: C# ----------
    if(HitPoints == null || HitPoints.Count == 0 || HitPoints[0] == null)
      return;

    var resultIds = new List<Point3d>();

    for(int i = 0; i < RaysCountPerPoint; i++)
    {
      var pointObj = HitPoints[VPID * RaysCountPerPoint + i] as dynamic;
      resultIds.Add(new Point3d(pointObj.x, pointObj.y, pointObj.z));
    } 


    A =  resultIds;
# ---------- end c_script ----------
item = ListItem(List=vantagepoints, Index=vantage_point_id, Wrap=True)
ln = Line(StartPoint=item, EndPoint=c_script.A)

# ----
panel_3 = Panel("""0
1""")
panel_4 = Panel("""3.001
90.001""")
cp = ClosestPoint(Point=destination, Cloud=nodepoints)  # -> ClosestPoint, CPIndex, Distance
# Shortest Path
cp_2 = ClosestPoint(Point=origin, Cloud=nodepoints)  # -> ClosestPoint, CPIndex, Distance
toggle_directed = BooleanToggle(False)
toggle_gpu_2 = BooleanToggle(True)

# ---- group: Offset line geometry to visualise both directions
# Centralities
c_script_2 = CSharpScript(lines=edgeundirectedlines)  # -> out, A; inputs lines: list of Line
# ---------- c_script_2: C# ----------
    var translatedLines = new Line[lines.Count * 2];
    int index = 0;
    double distance = 0.05;
 
    foreach (Line line in lines)
    {
      Point3d midpoint = line.PointAt(0.5);
      Vector3d tangent = line.UnitTangent;
      Vector3d normal = Vector3d.CrossProduct(tangent, Vector3d.ZAxis);
      normal *= distance;
      Point3d start = line.From + normal;
      Point3d end = line.To + normal;
      Line translatedLine = new Line(start, end); 

      translatedLines[index] = new Line(start, end);
      index++;
    }

    foreach (Line line in lines)
    {
      line.Flip();
      Point3d midpoint = line.PointAt(0.5);
      Vector3d tangent = line.UnitTangent;
      Vector3d normal = Vector3d.CrossProduct(tangent, Vector3d.ZAxis);
      normal *= distance;
      Point3d start = line.From + normal;
      Point3d end = line.To + normal;
      Line translatedLine = new Line(start, end); 

      translatedLines[index] = new Line(start, end);
      index++;
    }


    A = translatedLines;
# ---------- end c_script_2 ----------
filter = StreamFilter(Gate=toggle_directed, Stream0=edgeundirectedlines, Stream1=c_script_2.A)

# ----
# Isovist / Visibility along path
toggle_directed_2 = BooleanToggle(True)
lng_3 = ListLength(List=mesh)
c_f3_get_shortest_paths = CSharpScript(
    Graph=agraph,
    Origin=cp_2.CPIndex,
    Destination=cp.CPIndex,
    UseDirectedEdges=Toggle(True),
    f=c_functions.F3_GetShortestPath)  # -> out, NodesPath, EdgesPath, Distances; inputs Origin: Int32, Destination: Int32, UseDirectedEdges: Boolean
# ---------- c_f3_get_shortest_paths: C# ----------
    var F = f as   Func<object, int, int, bool, dynamic>;

    var result = F(Graph, Origin, Destination, UseDirectedEdges);

    NodesPath = result[0];
    EdgesPath = result[1];
    Distances = result[2];

    return;
# ---------- end c_f3_get_shortest_paths ----------
c_f11_get_alternative_paths = CSharpScript(
    Graph=agraph,
    Origin=cp_2.CPIndex,
    Destination=cp.CPIndex,
    f=c_functions.F11_AlternativeShortestPaths,
    WeightIds=panel_3,
    WeightTolerance=panel_4,
    Limit=stop_searching_at_this_number_of_paths)  # -> out, NodesPath, EdgesPath; inputs Origin: Int32, Destination: Int32, WeightIds: list of Int32, WeightTolerance: list of Double, Limit: Int32; disabled
# ---------- c_f11_get_alternative_paths: C# ----------
    var F = f as   Func<object, int, int, int[], double[], int, bool, bool, dynamic>;

    bool ToleranceOnly = true;
    bool SaveIndividualPaths = false;

    var result = F(Graph, Origin, Destination, WeightIds.ToArray(), WeightTolerance.ToArray(), Limit, ToleranceOnly, SaveIndividualPaths);

    DataTree<int> nodesPathTree = new DataTree<int>();
    DataTree<int> edgesPathTree = new DataTree<int>();

    for (int i = 0; i < result[0].Count; i++)
    {
      nodesPathTree.AddRange(result[0][i], new GH_Path(i));
      edgesPathTree.AddRange(result[1][i], new GH_Path(i));
    }

    NodesPath = nodesPathTree;
    EdgesPath = edgesPathTree;



    return;
# ---------- end c_f11_get_alternative_paths ----------
c_f7_calculate_bc_and_cc = CSharpScript(
    Graph=agraph,
    From=origin_ids,
    To=destination_ids,
    ODWeightMatrixReduced=c_f5_get_weight_matrix_as_matrix.DistanceMatrix,
    UseDirectedEdges=toggle_directed,
    CalculateBC=Toggle(True),
    CalculateCC=Toggle(True),
    CCWeightMatrixId=weight_matrix_id,
    GPU=toggle_gpu_2,
    f=c_functions.F7_CalculateCentralities)  # -> out, BCN, BCE, CCN, CCE; inputs From: list of Int32, To: list of Int32, UseDirectedEdges: Boolean, CalculateBC: Boolean, CalculateCC: Boolean, CCWeightMatrixId: Int32, GPU: Boolean
# ---------- c_f7_calculate_bc_and_cc: C# ----------
    var F = f as   Func < object, List < int>, List < int>, dynamic, bool, bool, bool,  int, bool, dynamic>;

    var result = F(Graph, From, To, ODWeightMatrixReduced, UseDirectedEdges, CalculateBC, CalculateCC, CCWeightMatrixId, GPU);

    BCN = result[0];
    BCE = result[1];

    CCN = result[2];
    CCE = result[3];

    return;
# ---------- end c_f7_calculate_bc_and_cc ----------
c_f12_calculate_path_visibility = CSharpScript(
    Graph=agraph,
    From=origin_ids,
    To=destination_ids,
    ODWeightMatrixReduced=c_f5_get_weight_matrix_as_matrix_pairwic.DistanceMatrix,
    Directed=toggle_directed_2,
    f=c_functions.F12_CalculatePathVisibility,
    MeshIdsPerRay=c_f13_isovist_3d_gpu.MeshIdsPerRay,
    EdgeToVantagePoints=c_create_vp_per_edge_tree.IndexTree,
    BrepsCount=lng_3)  # -> out, V; inputs From: list of Int32, To: list of Int32, Directed: Boolean, MeshIdsPerRay: list of Int32, EdgeToVantagePoints: tree of Int32, BrepsCount: Int32, GPU: Boolean
# ---------- c_f12_calculate_path_visibility: C# ----------
    var F = f as   Func < object, List <int>, List <int>, dynamic, List < int>,Dictionary < int, List < int>>,  int, bool, bool, dynamic>;


    var EdgeToVantagePointsDict = new Dictionary < int, List < int>>();

    for(int i = 0; i < EdgeToVantagePoints.BranchCount; i++)
    {
      EdgeToVantagePointsDict[i] = EdgeToVantagePoints.Branches[i].ToList();
    }

    var result = F(Graph, From, To, ODWeightMatrixReduced, MeshIdsPerRay, EdgeToVantagePointsDict, BrepsCount, Directed, false);


    V = result[0];
    return;
# ---------- end c_f12_calculate_path_visibility ----------

# ---- group: Visibility
values = Number(c_f12_calculate_path_visibility.V)
log = Logarithm(Value=values)
bnd = Bounds(Numbers=log)
remap = RemapNumbers(Value=log, Source=bnd, Target=Domain(0, 1))  # -> Mapped, Clipped
gradient = Gradient(
    LowerLimit=0,
    UpperLimit=1,
    Parameter=remap.Mapped,
    stops=[0: RGB(0, 0, 139), 0.221: RGB(50, 178, 206), 0.709: RGB(255, 215, 0), 1: RGB(255, 0, 0)])
preview = CustomPreview(Geometry=brep_obstacles, Material=gradient)

# ---- group: Edges
values_num_edges = Number(c_f7_calculate_bc_and_cc.BCE)
log_2 = Logarithm(Value=values_num_edges)
bnd_2 = Bounds(Numbers=log_2)
remap_2 = RemapNumbers(Value=log_2, Source=bnd_2, Target=Domain(0, 1))  # -> Mapped, Clipped
gradient_2 = Gradient(
    LowerLimit=0,
    UpperLimit=1,
    Parameter=remap_2.Mapped,
    stops=[0: RGB(0, 0, 139), 0.221: RGB(50, 178, 206), 0.709: RGB(255, 215, 0), 1: RGB(255, 0, 0)])
lines_crv = Curve(filter)
previewlw = CustomPreviewLineweights(Geometry=lines_crv, Shader=gradient_2, Thickness=Slider(5, range=0..10), Absolute=False)

# ---- group: Nodes
values_num_nodes = Number(c_f7_calculate_bc_and_cc.BCN)
log_3 = Logarithm(Value=values_num_nodes)
bnd_3 = Bounds(Numbers=log_3)
remap_3 = RemapNumbers(Value=log_3, Source=bnd_3, Target=Domain(0, 1))  # -> Mapped, Clipped
gradient_3 = Gradient(
    LowerLimit=0,
    UpperLimit=1,
    Parameter=remap_3.Mapped,
    stops=[0: RGB(0, 0, 139), 0.221: RGB(50, 178, 206), 0.709: RGB(255, 215, 0), 1: RGB(255, 0, 0)])
symsim = SymbolSimple(Style=5, Size=Slider(6, range=0..10), Rotation=0, Colour=gradient_3)
symbol = SymbolDisplay(Location=nodepoints, Display=symsim)

# ----
nodespathalternative = Data(c_f11_get_alternative_paths.NodesPath)
edgespathalternative = Data(c_f11_get_alternative_paths.EdgesPath)
nodespath = Data(c_f3_get_shortest_paths.NodesPath)
edgespath = Data(c_f3_get_shortest_paths.EdgesPath)

# ---- group: Get vec Path
item_2 = ListItem(List=edgedirectedlines, Index="0", Wrap=True)
explode_2 = Explode(Curve=item_2, Recursive=True)  # -> Segments, Vertices
item_3 = ListItem(List=explode_2.Vertices, Index=0, Wrap=True)  # -> Item, Item1
vec2pt = Vector2Pt(PointA=item_3.Item, PointB=item_3.Item1, Unitize=False)  # -> Vector, Length
vdis = VectorDisplay(Anchor=item_3.Item, Vector=vec2pt.Vector)

# ---- group: Shortest Path Visualisation
pointspath = Data(nodespath)
linespath = Data(edgespath)
swatch = ColourSwatch(SwatchColor=RGB(84, 199, 116))
item_4 = ListItem(List=edgedirectedlines, Index=linespath, Wrap=True)
item_5 = ListItem(List=nodepoints, Index=pointspath, Wrap=True)
symsim_2 = SymbolSimple(Style=7, Size=12, Rotation=0, Colour=swatch)
symbol_2 = SymbolDisplay(Location=item_5, Display=symsim_2)
previewlw_2 = CustomPreviewLineweights(Geometry=item_4, Shader=swatch, Thickness=Slider(5, range=0..10), Absolute=False)

# ---- group: Get vec Path
explode_3 = Explode(Curve=c_script_2.A, Recursive=True)  # -> Segments, Vertices
item_6 = ListItem(List=explode_3.Vertices, Index=0, Wrap=True)  # -> Item, Item1
vec2pt_2 = Vector2Pt(PointA=item_6.Item, PointB=item_6.Item1, Unitize=False)  # -> Vector, Length
vdis_2 = VectorDisplay(Anchor=item_6.Item, Vector=vec2pt_2.Vector)

# ---- group: Visualisation
eval_2 = EvaluateCurve(Curve=c_script_2.A, Parameter=Slider(0.5, range=0..1))  # -> Point, Tangent, Angle
points = PointList(Points=eval_2.Point, Size=Slider(0.07, range=0..1.1))
points_2 = PointList(Points=nodepoints, Size=Slider(0.3, range=0..1))

# ---- group: vector path
item_7 = ListItem(List=edgedirectedlines, Index=linespath, Wrap=True)
end = EndPoints(Curve=item_7)  # -> Start, End
vdis_3 = VectorDisplay(Anchor=end.Start, Vector=item_7)

# ----
len = Length(Curve=item_4)
ma = MassAddition(Input=len)  # -> Result, PartialResults
distances = Panel(c_f3_get_shortest_paths.Distances)
panel_5 = Panel(ma.Result)
