# Grasshopper definition GraFit Network Components Example.gh (Grasshopper 1.0.7)
# plug-ins: Human, GraFitNodes

crv = Curve([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])
crv_2 = Curve([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])
crv_3 = Curve([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])
crv_4 = Curve([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])
crv_5 = Curve([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])
explode = Explode(Curve=crv_3, Recursive=True)  # -> flatten(Segments), Vertices
line = Line(flatten(explode.Segments))
lng = ListLength(List=graft(line))  # -> expr("x*1", flatten(Length))
buildgraph = BuildGraph(
    Lines=line,
    CustomWeightsForward=lng,
    CustomWeightsBackward=lng,
    LengthCoefficient=Slider(1, range=0..1),
    AngleCoefficient=Slider(1, range=0..1),
    CustomCoefficient=Slider(1, range=0..1),
    GPU=False)  # -> Graph, Nodes, Edges
number_slider = Slider(3, range=0..3)
destination = Point(Point(-4.314374197, 55.34766672, 0))
origin = Point(Point(4.386831046, 32.3213065, 0))
panel = Panel("""0
19
1""")
panel_2 = Panel("""10
9
11
26
22""")
c_all_nodes = CSharpScript(nodes=buildgraph.Nodes)  # -> out, A; inputs nodes: list of Int32
# ---------- c_all_nodes: C# usings ----------
using System.Linq;
# ---------- c_all_nodes: C# ----------
    A = nodes.Select((s, i) => i);
# ---------- end c_all_nodes ----------
cp = ClosestPoint(Point=origin, Cloud=buildgraph.Nodes)  # -> ClosestPoint, CPIndex, Distance
cp_2 = ClosestPoint(Point=destination, Cloud=buildgraph.Nodes)  # -> ClosestPoint, CPIndex, Distance
to = Integer(panel_2)
from = Integer(panel)
node_id = Panel("2")
edge_id = Panel("26")
c_test_matrix = CSharpScript(From=from, To=to)  # -> out, DistanceMatrix; inputs From: list of Int32, To: list of Int32
# ---------- c_test_matrix: C# usings ----------
//using Grafit;
//using GrafitRhino;
using System.Linq;
# ---------- c_test_matrix: C# ----------
    int FromN = From.Count;
    int ToN = To.Count;

    var reducedODMatrix = new Matrix(FromN, ToN);

    for(int i = 0; i < FromN; i++)
    {
      for(int j = 0; j < ToN; j++)
      {
        reducedODMatrix[i, j] = 1;
      }
      reducedODMatrix[i, i] = 0;
    }



    DistanceMatrix = reducedODMatrix;

    return;
# ---------- end c_test_matrix ----------
getshortestpath = GetShortestPath(Graph=buildgraph.Graph, Origin=cp.CPIndex, Destination=cp_2.CPIndex)  # -> Metric, Angle, Custom, Aggregated, Nodes, Edges
getedgesbynode = GetEdgesByNode(Graph=buildgraph.Graph, NodeId=node_id)
getnodesbyedge = GetNodesByEdge(Graph=buildgraph.Graph, EdgeId=edge_id)
panel_3 = Panel([getshortestpath.Metric, getshortestpath.Angle, getshortestpath.Custom, getshortestpath.Aggregated])
c_move = CSharpScript(directedEdges=flatten(buildgraph.Edges))  # -> out, A; inputs directedEdges: list of Line
# ---------- c_move: C# ----------
    var lines = directedEdges.Take(directedEdges.Count() / 2).ToList();
    var translatedLines = new Line[lines.Count * 2];
    int index = 0;
    double distance = 0.05;



    foreach (Line line in lines)
    {
      Point3d midpoint = line.PointAt(0.5);
      Vector3d tangent = line.UnitTangent;
      Vector3d normal = Vector3d.CrossProduct(tangent, Vector3d.ZAxis);
      normal *= distance;
      Point3d start = line.From + normal;
      Point3d end = line.To + normal;
      Line translatedLine = new Line(start, end);

      translatedLines[index] = new Line(start, end);
      index++;
    }

    foreach (Line line in lines)
    {
      line.Flip();
      Point3d midpoint = line.PointAt(0.5);
      Vector3d tangent = line.UnitTangent;
      Vector3d normal = Vector3d.CrossProduct(tangent, Vector3d.ZAxis);
      normal *= distance;
      Point3d start = line.From + normal;
      Point3d end = line.To + normal;
      Line translatedLine = new Line(start, end);

      translatedLines[index] = new Line(start, end);
      index++;
    }


    A = translatedLines;
# ---------- end c_move ----------
getgraphmeasures = GetGraphMeasures(
    Graph=buildgraph.Graph,
    DistanceMatrixIndex=number_slider,
    ODWeightMatrix=c_test_matrix.DistanceMatrix,
    Origins=from,
    Destinations=to,
    GPU=False)  # -> BCN, flatten(BCE), CCN, flatten(CCE)
getdistancematrix = GetDistanceMatrix(Graph=buildgraph.Graph, DistanceMatrixIndex=number_slider, Origins=from, Destinations=to)

# ---- group: Shortest Path
node_points_ids = Data(getshortestpath.Nodes)
edge_lines_ids = Data(getshortestpath.Edges)
swatch = ColourSwatch(SwatchColor=RGB(84, 199, 116))
item = ListItem(List=flatten(buildgraph.Edges), Index=edge_lines_ids, Wrap=True)
item_2 = ListItem(List=buildgraph.Nodes, Index=node_points_ids, Wrap=True)
symsim = SymbolSimple(Style=7, Size=12, Rotation=0, Colour=swatch)
previewlw = CustomPreviewLineweights(Geometry=item, Shader=swatch, Thickness=Slider(5, range=0..10), Absolute=False)
symbol = SymbolDisplay(Location=item_2, Display=symsim)

# ---- group: Nodes by Edge Id
node_points_ids_2 = Data(getnodesbyedge)
edge_lines_ids_2 = Data(edge_id)
swatch_2 = ColourSwatch(SwatchColor=RGB(0, 255, 234))
item_3 = ListItem(List=flatten(c_move.A), Index=edge_lines_ids_2, Wrap=True)
item_4 = ListItem(List=buildgraph.Nodes, Index=node_points_ids_2, Wrap=True)
symsim_2 = SymbolSimple(Style=7, Size=12, Rotation=0, Colour=swatch_2)
previewlw_2 = CustomPreviewLineweights(Geometry=item_3, Shader=swatch_2, Thickness=Slider(5, range=0..10), Absolute=False)
symbol_2 = SymbolDisplay(Location=item_4, Display=symsim_2)

# ---- group: Edges By Node Id
node_points_ids_3 = Data(node_id)
edge_lines_ids_3 = Data(getedgesbynode)
swatch_3 = ColourSwatch(SwatchColor=RGB(247, 255, 0))
item_5 = ListItem(List=flatten(c_move.A), Index=edge_lines_ids_3, Wrap=True)
item_6 = ListItem(List=buildgraph.Nodes, Index=node_points_ids_3, Wrap=True)
symsim_3 = SymbolSimple(Style=7, Size=12, Rotation=0, Colour=swatch_3)
previewlw_3 = CustomPreviewLineweights(Geometry=item_5, Shader=swatch_3, Thickness=Slider(5, range=0..10), Absolute=False)
symbol_3 = SymbolDisplay(Location=item_6, Display=symsim_3)

# ---- group: Nodes
values_num_nodes = Number(getgraphmeasures.BCN)
log = Logarithm(Value=values_num_nodes)
bnd = Bounds(Numbers=log)
remap = RemapNumbers(Value=log, Source=bnd, Target=Domain(0, 1))  # -> Mapped, Clipped
gradient = Gradient(
    LowerLimit=0,
    UpperLimit=1,
    Parameter=remap.Mapped,
    stops=[0: RGB(0, 0, 139), 0.221: RGB(50, 178, 206), 0.709: RGB(255, 215, 0), 1: RGB(255, 0, 0)])
symsim_4 = SymbolSimple(Style=5, Size=Slider(6, range=0..10), Rotation=0, Colour=gradient)
symbol_4 = SymbolDisplay(Location=buildgraph.Nodes, Display=symsim_4)

# ---- group: Edges
values_num_edges = Number(getgraphmeasures.BCE)
lines_crv = Curve(c_move.A)
log_2 = Logarithm(Value=values_num_edges)
bnd_2 = Bounds(Numbers=log_2)
remap_2 = RemapNumbers(Value=log_2, Source=bnd_2, Target=Domain(0, 1))  # -> Mapped, Clipped
gradient_2 = Gradient(
    LowerLimit=0,
    UpperLimit=1,
    Parameter=remap_2.Mapped,
    stops=[0: RGB(0, 0, 139), 0.221: RGB(50, 178, 206), 0.709: RGB(255, 215, 0), 1: RGB(255, 0, 0)])
previewlw_4 = CustomPreviewLineweights(Geometry=lines_crv, Shader=gradient_2, Thickness=Slider(5, range=0..10), Absolute=False)
