# Grasshopper definition GraFit Network Python Cluster Example.gh (Grasshopper 1.0.7)
# plug-ins: Human

panel = Panel("C:/Users/fesmc/AppData/Roaming/Grasshopper/Libraries/Grafit/Grafit.dll")  # disabled
panel_2 = Panel("C:/Users/fesmc/AppData/Roaming/Grasshopper/Libraries/Grafit/GrafitRhino.dll")  # disabled

# ---- group: Test Network Geometry
crv_random_network_s = Curve([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])
crv_random_network_l = Curve([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])
crv_regular_grid = Curve([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])

# ----
c_script = CSharpScript()  # -> out, GrafitPath, GrafitRhinoPath
# ---------- c_script: C# ----------
    // Get the default library folder path
    string defaultLibFolderPath = @"%Appdata%\Grasshopper\Libraries\Grafit\";

    GrafitPath = defaultLibFolderPath + "Grafit.dll";
    GrafitRhinoPath = defaultLibFolderPath + "GrafitRhino.dll";
# ---------- end c_script ----------
explode = Explode(Curve=crv_random_network_l, Recursive=True)  # -> flatten(Segments), Vertices
line = Line(flatten(explode.Segments))
# For example, set all additional edge weights as 1. Shortest path then will reflect number of segments in path. This weights are stored as WeightMatrix with index #1
lng = ListLength(List=line)
toggle_calculateallmatrices = BooleanToggle(False)
panel_3 = Panel("""0.5
0.1""")
toggle_usefiltermatrix = BooleanToggle(False)
repeat = RepeatData(Data=" 1", Length=lng)
toggle_gpu = BooleanToggle(False)
weight_matrix_id = Panel("1")
weight_filter_matrix_id = Panel("0")
data = Data(repeat)
cluster_python_f14_dual_graph_cognitive = ClusterPythonF14DualGraphCognitiveDistance()  # "Cluster Python F14 Dual Graph Cognitive Distance"; disabled
cluster_python_f2_primal_directed_graph = ClusterPythonF2PrimalDirectedGraph(
    libpathgrafit=c_script.GrafitPath,
    libpathgrafitrhino=c_script.GrafitRhinoPath,
    linegeometry=line,
    edgeweightsforward=data,
    edgeweightsbackward=data,
    weightmatrixindexmain=weight_matrix_id,
    weightmatrixindexfilter=weight_filter_matrix_id,
    calculateallmatrices=toggle_calculateallmatrices,
    usefiltermatrix=toggle_usefiltermatrix,
    gpu=toggle_gpu)
cluster_python_f1_dual_graph = ClusterPythonF1DualGraph(
    libpathgrafit=c_script.GrafitPath,
    libpathgrafitrhino=c_script.GrafitRhinoPath,
    linegeometry=line,
    weightmatrixindexmain=weight_matrix_id,
    weightmatrixindexfilter=weight_filter_matrix_id,
    calculateallmatrices=toggle_calculateallmatrices,
    usefiltermatrix=toggle_usefiltermatrix,
    gpu=toggle_gpu)
brep_obstacles = Brep(flatten([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]))
srf_ground = Surface(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)
origin_ids = Panel("""0
1
6
11""")
destination_ids = Panel("""3
5
7
34""")
agraph = Data(cluster_python_f2_primal_directed_graph)
vertical_angle_offset = Slider(0, range=0..100)
horizontal_precision = Slider(10, range=0..10)
vertical_precision = Slider(10, range=0..10)
toggle_out_hit_points = BooleanToggle(False)
mesh = MeshBrep(
    Brep=brep_obstacles,
    Settings={GridMaxCount=0, GridMinCount=16, JaggedSeams=False, MaxEdgeLength=0, MinEdgeLength=0.0001, MinTolerance=0, Refine=True, RefineAngle=0, RelativeTolerance=0.65, SimplePlanes=True, Tolerance=0})
mesh_2 = MeshBrep(
    Brep=srf_ground,
    Settings={GridMaxCount=0, GridMinCount=16, JaggedSeams=False, MaxEdgeLength=0, MinEdgeLength=0.0001, MinTolerance=0, Refine=True, RefineAngle=0, RelativeTolerance=0.65, SimplePlanes=True, Tolerance=0})
cluster_python_f5_get_weight_matrix_as_m = ClusterPythonF5GetWeightMatrixAsMatrix(
    libpathgrafit=c_script.GrafitPath,
    libpathgrafitrhino=c_script.GrafitRhinoPath,
    graph=agraph,
    from=origin_ids,
    to=destination_ids,
    weightmatrixindex=weight_matrix_id)  # "Cluster Python F5 Get Weight Matrix As Matrix"
cluster_python_f4_generate_geometry = ClusterPythonF4GenerateGeometry(libpathgrafit=c_script.GrafitPath, libpathgrafitrhino=c_script.GrafitRhinoPath, graph=agraph)  # -> nodeaspoints, edgesdirected, edgesundirected
cluster_python_f10_disconnectedparts = ClusterPythonF10DisconnectedParts(libpathgrafit=c_script.GrafitPath, libpathgrafitrhino=c_script.GrafitRhinoPath, graph=agraph)  # disabled
edgeundirectedlines = Data(cluster_python_f4_generate_geometry.edgesundirected)
undiredges = Line(edgeundirectedlines)
# Each edge here have 2 points. This tree structure is converted to a flat list of points and to a tree where each edge index corresponds to flat point index
eval = EvaluateCurve(Curve=graft(undiredges), Parameter=panel_3)  # -> Point, Tangent, Angle
move = Move(Geometry=eval.Point, Motion="{0, 0, 1}")  # -> simplify(Geometry), Transform
c_create_vp_per_edge_tree = CSharpScript(GeometryTree=move.Geometry)  # -> out, FlatPointsList, IndexTree; inputs GeometryTree: tree of Point3d
# ---------- c_create_vp_per_edge_tree: C# ----------
    var resultIndex = new DataTree<int>();
    var resultPoints = new List<Point3d>();

    int flatIndex = 0;

    for(int i = 0; i < GeometryTree.BranchCount; i++)
    {
      foreach(var item in GeometryTree.Branches[i])
      {
        resultIndex.Add(flatIndex, new GH_Path(i));
        resultPoints.Add(item);
        flatIndex++;
      }
    }

    FlatPointsList = resultPoints;
    IndexTree = resultIndex;
# ---------- end c_create_vp_per_edge_tree ----------
vantagepoints = Point(c_create_vp_per_edge_tree.FlatPointsList)

vec = VectorXYZ(XComponent=0, YComponent="-1", ZComponent=0)  # -> Vector, Length
lng_2 = ListLength(List=vantagepoints)
repeat_2 = RepeatData(Data=vec.Vector, Length=lng_2)

cluster_python_f13_isovist_3d_gpu = ClusterPythonF13Isovist3DGPU(
    libpathgrafit=c_script.GrafitPath,
    libpathgrafitrhino=c_script.GrafitRhinoPath,
    vp=vantagepoints,
    os=mesh,
    gs=mesh_2,
    vd=repeat_2,
    vr=Slider(1000, range=0..1000),
    hva=Slider(360, range=0..1000),
    vva=Slider(90, range=0..100),
    hpr=horizontal_precision,
    vpr=vertical_precision,
    vao=vertical_angle_offset,
    ohp=toggle_out_hit_points)  # -> hitpoints, flatten(meshidsperray), numberofrays
edgedirectedlines = Data(cluster_python_f4_generate_geometry.edgesdirected)
nodepoints = Data(cluster_python_f4_generate_geometry.nodeaspoints)
stop_searching_at_this_number_of_paths = Panel("800")

# ---- group: Get Rays for Vantage Point
vantage_point_id = Panel("5")
c_script_2 = CSharpScript(
    VPID=vantage_point_id,
    RaysCountPerPoint=cluster_python_f13_isovist_3d_gpu.numberofrays,
    HitPoints=cluster_python_f13_isovist_3d_gpu.hitpoints)  # -> out, A; inputs VPID: Int32, RaysCountPerPoint: Int32, HitPoints: list
# ---------- c_script_2: C# ----------
    if(HitPoints == null || HitPoints.Count == 0 || HitPoints[0] == null)
      return;

    var resultIds = new List<Point3d>();

    for(int i = 0; i < RaysCountPerPoint; i++)
    {
      var pointObj = HitPoints[VPID * RaysCountPerPoint + i] as dynamic;
      resultIds.Add(new Point3d(pointObj.x, pointObj.y, pointObj.z));
    } 


    A =  resultIds;
# ---------- end c_script_2 ----------
item = ListItem(List=vantagepoints, Index=vantage_point_id, Wrap=True)
ln = Line(StartPoint=item, EndPoint=c_script_2.A)

# ----
destination = Point(Point(11.3919731, 64.68040582, 0))
origin = Point(Point(-37.08688782, 11.53385668, 0))
panel_4 = Panel("""0
1""")
panel_5 = Panel("""3.001
90.001""")
cp = ClosestPoint(Point=destination, Cloud=nodepoints)  # -> ClosestPoint, CPIndex, Distance
# Shortest Path
cp_2 = ClosestPoint(Point=origin, Cloud=nodepoints)  # -> ClosestPoint, CPIndex, Distance
toggle_directed = BooleanToggle(False)
toggle_gpu_2 = BooleanToggle(True)

# ---- group: Offset line geometry to visualise both directions
# Centralities
c_script_3 = CSharpScript(lines=edgeundirectedlines)  # -> out, A; inputs lines: list of Line
# ---------- c_script_3: C# usings ----------
using System.Linq;
# ---------- c_script_3: C# ----------
    var translatedLines = new Line[lines.Count * 2];
    int index = 0;
    double distance = 0.05;
 
    foreach (Line line in lines)
    {
      Point3d midpoint = line.PointAt(0.5);
      Vector3d tangent = line.UnitTangent;
      Vector3d normal = Vector3d.CrossProduct(tangent, Vector3d.ZAxis);
      normal *= distance;
      Point3d start = line.From + normal;
      Point3d end = line.To + normal;
      Line translatedLine = new Line(start, end); 

      translatedLines[index] = new Line(start, end);
      index++;
    }

    foreach (Line line in lines)
    {
      line.Flip();
      Point3d midpoint = line.PointAt(0.5);
      Vector3d tangent = line.UnitTangent;
      Vector3d normal = Vector3d.CrossProduct(tangent, Vector3d.ZAxis);
      normal *= distance;
      Point3d start = line.From + normal;
      Point3d end = line.To + normal;
      Line translatedLine = new Line(start, end); 

      translatedLines[index] = new Line(start, end);
      index++;
    }


    A = translatedLines;
# ---------- end c_script_3 ----------
filter = StreamFilter(Gate=toggle_directed, Stream0=edgeundirectedlines, Stream1=c_script_3.A)

# ----
# Isovist / Visibility along path
toggle_directed_2 = BooleanToggle(True)
cluster_python_f11_get_alternative_paths = ClusterPythonF11GetAlternativePaths(
    libpathgrafit=c_script.GrafitPath,
    libpathgrafitrhino=c_script.GrafitRhinoPath,
    graph=agraph,
    origin=cp_2.CPIndex,
    destination=cp.CPIndex,
    weightids=panel_4,
    weighttolerance=panel_5,
    limit=stop_searching_at_this_number_of_paths)  # -> nodespath, edgespath; disabled
cluster_python_f3_get_shortest_paths = ClusterPythonF3GetShortestPaths(
    libpathgrafit=c_script.GrafitPath,
    libpathgrafitrhino=c_script.GrafitRhinoPath,
    graph=agraph,
    origin=cp_2.CPIndex,
    destination=cp.CPIndex,
    usedirectededges=Toggle(True))  # -> nodespath, edgespath, distances
lng_3 = ListLength(List=mesh)
cluster_python_f7_calculate_bc_and_cc = ClusterPythonF7CalculateBCAndCC(
    libpathgrafit=c_script.GrafitPath,
    libpathgrafitrhino=c_script.GrafitRhinoPath,
    graph=agraph,
    from=origin_ids,
    to=destination_ids,
    odweightmatrixreduced=cluster_python_f5_get_weight_matrix_as_m,
    usedirectededges=toggle_directed,
    calculatebc=Toggle(True),
    calculatecc=Toggle(True),
    ccweightmatrixid=weight_matrix_id,
    gpu=toggle_gpu_2)  # -> bcn, bce, ccn, cce
cluster_python_f12_calculate_path_visibi = ClusterPythonF12CalculatePathVisibility(
    libpathgrafit=c_script.GrafitPath,
    libpathgrafitrhino=c_script.GrafitRhinoPath,
    graph=agraph,
    from=origin_ids,
    to=destination_ids,
    odweightmatrixreduced=cluster_python_f5_get_weight_matrix_as_m,
    directed=toggle_directed_2,
    meshidsperray=cluster_python_f13_isovist_3d_gpu.meshidsperray,
    edgetovantagepoints=c_create_vp_per_edge_tree.IndexTree,
    brepscount=lng_3)  # "Cluster Python F12 Calculate Path Visibility"

# ---- group: Visibility
values = Number(cluster_python_f12_calculate_path_visibi)
log = Logarithm(Value=values)
bnd = Bounds(Numbers=log)
remap = RemapNumbers(Value=log, Source=bnd, Target=Domain(0, 1))  # -> Mapped, Clipped
gradient = Gradient(
    LowerLimit=0,
    UpperLimit=1,
    Parameter=remap.Mapped,
    stops=[0: RGB(0, 0, 139), 0.221: RGB(50, 178, 206), 0.709: RGB(255, 215, 0), 1: RGB(255, 0, 0)])
preview = CustomPreview(Geometry=brep_obstacles, Material=gradient)

# ---- group: Edges
values_num_edges = Number(cluster_python_f7_calculate_bc_and_cc.bce)
log_2 = Logarithm(Value=values_num_edges)
bnd_2 = Bounds(Numbers=log_2)
remap_2 = RemapNumbers(Value=log_2, Source=bnd_2, Target=Domain(0, 1))  # -> Mapped, Clipped
gradient_2 = Gradient(
    LowerLimit=0,
    UpperLimit=1,
    Parameter=remap_2.Mapped,
    stops=[0: RGB(0, 0, 139), 0.221: RGB(50, 178, 206), 0.709: RGB(255, 215, 0), 1: RGB(255, 0, 0)])
lines_crv = Curve(filter)
previewlw = CustomPreviewLineweights(Geometry=lines_crv, Shader=gradient_2, Thickness=Slider(5, range=0..10), Absolute=False)

# ---- group: Nodes
values_num_nodes = Number(cluster_python_f7_calculate_bc_and_cc.bcn)
log_3 = Logarithm(Value=values_num_nodes)
bnd_3 = Bounds(Numbers=log_3)
remap_3 = RemapNumbers(Value=log_3, Source=bnd_3, Target=Domain(0, 1))  # -> Mapped, Clipped
gradient_3 = Gradient(
    LowerLimit=0,
    UpperLimit=1,
    Parameter=remap_3.Mapped,
    stops=[0: RGB(0, 0, 139), 0.221: RGB(50, 178, 206), 0.709: RGB(255, 215, 0), 1: RGB(255, 0, 0)])
symsim = SymbolSimple(Style=5, Size=Slider(6, range=0..10), Rotation=0, Colour=gradient_3)
symbol = SymbolDisplay(Location=nodepoints, Display=symsim)

# ----
nodespathalternative = Data(cluster_python_f11_get_alternative_paths.nodespath)
edgespathalternative = Data(cluster_python_f11_get_alternative_paths.edgespath)
nodespath = Data(cluster_python_f3_get_shortest_paths.nodespath)
edgespath = Data(cluster_python_f3_get_shortest_paths.edgespath)

# ---- group: Get vec Path
item_2 = ListItem(List=edgedirectedlines, Index="0", Wrap=True)
explode_2 = Explode(Curve=item_2, Recursive=True)  # -> Segments, Vertices
item_3 = ListItem(List=explode_2.Vertices, Index=0, Wrap=True)  # -> Item, Item1
vec2pt = Vector2Pt(PointA=item_3.Item, PointB=item_3.Item1, Unitize=False)  # -> Vector, Length
vdis = VectorDisplay(Anchor=item_3.Item, Vector=vec2pt.Vector)

# ---- group: Shortest Path Visualisation
pointspath = Data(nodespath)
linespath = Data(edgespath)
swatch = ColourSwatch(SwatchColor=RGB(84, 199, 116))
item_4 = ListItem(List=nodepoints, Index=pointspath, Wrap=True)
item_5 = ListItem(List=edgedirectedlines, Index=linespath, Wrap=True)
symsim_2 = SymbolSimple(Style=7, Size=12, Rotation=0, Colour=swatch)
symbol_2 = SymbolDisplay(Location=item_4, Display=symsim_2)
previewlw_2 = CustomPreviewLineweights(Geometry=item_5, Shader=swatch, Thickness=Slider(5, range=0..10), Absolute=False)

# ---- group: Get vec Path
explode_3 = Explode(Curve=c_script_3.A, Recursive=True)  # -> Segments, Vertices
item_6 = ListItem(List=explode_3.Vertices, Index=0, Wrap=True)  # -> Item, Item1
vec2pt_2 = Vector2Pt(PointA=item_6.Item, PointB=item_6.Item1, Unitize=False)  # -> Vector, Length
vdis_2 = VectorDisplay(Anchor=item_6.Item, Vector=vec2pt_2.Vector)

# ---- group: Visualisation
eval_2 = EvaluateCurve(Curve=c_script_3.A, Parameter=Slider(0.5, range=0..1))  # -> Point, Tangent, Angle
points = PointList(Points=eval_2.Point, Size=Slider(0.07, range=0..1.1))
points_2 = PointList(Points=nodepoints, Size=Slider(0.3, range=0..1))

# ---- group: vector path
item_7 = ListItem(List=edgedirectedlines, Index=linespath, Wrap=True)
end = EndPoints(Curve=item_7)  # -> Start, End
vdis_3 = VectorDisplay(Anchor=end.Start, Vector=item_7)

# ==== cluster ClusterPythonF1DualGraph
weightmatrixindexmain = ClusterInput()
weightmatrixindexfilter = ClusterInput()
calculateallmatrices = ClusterInput()
libpathgrafitrhino = ClusterInput()
usefiltermatrix = ClusterInput()
linegeometry = ClusterInput()
libpathgrafit = ClusterInput()
gpu = ClusterInput()
python_f1_dual_graph = GhPythonScript(
    LibPathGrafit=libpathgrafit,
    LibPathGrafitRhino=libpathgrafitrhino,
    LineGeometry=linegeometry,
    WeightMatrixIndexMain=weightmatrixindexmain,
    WeightMatrixIndexFilter=weightmatrixindexfilter,
    CalculateAllMatrices=calculateallmatrices,
    UseFilterMatrix=usefiltermatrix,
    GPU=gpu)  # -> out, DualGraph; inputs LineGeometry: list of Line, WeightMatrixIndexMain: Int32, WeightMatrixIndexFilter: Int32, CalculateAllMatrices: Boolean, UseFilterMatrix: Boolean, GPU: Boolean
# ---------- python_f1_dual_graph: Python ----------
import rhinoscriptsyntax as rs
import Rhino.Geometry as rg
import sys
import clr

clr.AddReference("Grafit") 
clr.AddReference("GrafitRhino")  

#if above AddReference by name not working
#clr.AddReferenceToFile(LibPathGrafit)
#clr.AddReferenceToFile(LibPathGrafitRhino)  

from Grafit import *
from GrafitRhino import *
from System import Array

primalGraph = {}
dualGraph = {}


#Create Primal Graph from which Dual Graph will be created
if True: 
    lineGeometry = Array[CWLine](map(lambda s: CWLine(s), LineGeometry))

    graphElements, edgeLengths = GeometryToGraphElements[rg.Point3d, rg.Line].GetNodesAndEdgesFromLines(lineGeometry)

    primalGraph = CPrimalDirectedGraph[rg.Point3d, rg.Line](graphElements)
    primalGraph.AddWeightMatrix(edgeLengths)  # index 0
    primalGraph.AddEmptyWeightMatrix()  # index 1 - angles
    
    for i in range(len(primalGraph.UndirectedEdges)):
        n1 = primalGraph.UndirectedEdges[i][0]  # start node of edge #i
        n2 = primalGraph.UndirectedEdges[i][1]  # end node of edge #i
    
        weight_1 = 0.0  # angle of a single edge is 0.0 deg
        weight_matrix_id = 1
    
        primalGraph.SetWeightMatrixAndEdgeValue(weight_1, n1, n2, weight_matrix_id)  # forward direction
        primalGraph.SetWeightMatrixAndEdgeValue(weight_1, n2, n1, weight_matrix_id)  # backward direction

# Create Dual Graph
if True:    
    # Get dual nodes and edges from primal graph
    graphElements, edgeLengths, edgeAngles = GeometryToGraphElements[rg.Point3d, rg.Line].GetDualNodesAndEdgesFromPrimalGraph(primalGraph)
    
    # Create the dual graph using the primal graph and dual graph elements
    dualGraph = CDualUndirectedGraph[rg.Point3d, rg.Line](primalGraph, graphElements)

    # The order of dual graph weight matrices must be the same as in the primal graph
    # First, add dual lengths
    dualGraph.AddWeightMatrix(edgeLengths)  # index 0
    # Second, add dual angles
    dualGraph.AddWeightMatrix(edgeAngles)  # index 1
    
    # If you need to set individual weight matrix values, you can do so here
    # some_weight = 0
    # weight_matrix_index = 2
    # dualGraph.SetWeightMatrixValue(some_weight, prim_edge_id_0, prim_edge_id_1, weight_matrix_index)
    
    if UseFilterMatrix:
        dualGraph.APShortestPathsByManyWeights(WeightMatrixIndexMain, WeightMatrixIndexFilter, GPU)
    else:
        dualGraph.APShortestPathsByOneWeight(WeightMatrixIndexMain, GPU) 

# If graph has more than 1 weight matrix, calculate distances along shortest paths according to all other weights
if CalculateAllMatrices:
    # Select which weights are needed to measure shortest paths
    # By default, all other matrices which are not the main are selected
    allIds = list(range(len(dualGraph.weightMatrices)))
    otherMatricesIds = [i for i in allIds if i != WeightMatrixIdxMain]
    dualGraph.FillWeightMatrixBySPRestore(otherMatricesIds, GPU)
    
DualGraph = dualGraph
# ---------- end python_f1_dual_graph ----------
dualgraph = ClusterOutput(python_f1_dual_graph.DualGraph)

# ==== cluster ClusterPythonF14DualGraphCognitiveDistance
libpathgrafit = ClusterInput()
libpathgrafitrhino = ClusterInput()
linegeometry = ClusterInput()
edgeislinkundir = ClusterInput()
edgesisactivitynodelinkundir = ClusterInput()
timeweightsin = ClusterInput()
timeweightsout = ClusterInput()
weightmatrixindexmain = ClusterInput()
weightmatrixindexfilter = ClusterInput()
gpu = ClusterInput()
python_f14_dual_graph_cognitive_distance = GhPythonScript(
    LibPathGrafit=libpathgrafit,
    LibPathGrafitRhino=libpathgrafitrhino,
    LineGeometry=linegeometry,
    EdgeIsLinkUndir=edgeislinkundir,
    EdgesIsActivityNodeLinkUndir=edgesisactivitynodelinkundir,
    TimeWeightsIn=timeweightsin,
    TimeWeightsOut=timeweightsout,
    WeightMatrixIndexMain=weightmatrixindexmain,
    WeightMatrixIndexFilter=weightmatrixindexfilter,
    GPU=gpu)  # -> out, DualGraph; inputs LineGeometry: list of Line, EdgeIsLinkUndir: list of Boolean, EdgesIsActivityNodeLinkUndir: list of Boolean, TimeWeightsIn: list, TimeWeightsOut: list, WeightMatrixIndexMain: Int32, WeightMatrixIndexFilter: Int32, GPU: Boolean
# ---------- python_f14_dual_graph_cognitive_distance: Python ----------
import rhinoscriptsyntax as rs
import Rhino.Geometry as rg
import sys
import clr

clr.AddReference("Grafit") 
clr.AddReference("GrafitRhino")  

#clr.AddReferenceToFile(LibPathGrafit)
#clr.AddReferenceToFile(LibPathGrafitRhino)  

from Grafit import *
from GrafitRhino import *
from System import Array

primalGraph = {}
dualGraph = {}

# Positive infinity (similar to double.PositiveInfinity in C#)
double_PositiveInfinity = float('inf')

# Maximum finite positive value (similar to double.MaxValue in C#)
double_MaxValue = sys.float_info.max


#Create Primal Graph from which Dual Graph will be created
if True: 
    lineGeometry = Array[CWLine](map(lambda s: CWLine(s), LineGeometry))

    graphElements, edgeLengths = GeometryToGraphElements[rg.Point3d, rg.Line].GetNodesAndEdgesFromLines(lineGeometry)

    primalGraph = CPrimalDirectedGraph[rg.Point3d, rg.Line](graphElements)
    primalGraph.AddWeightMatrix(edgeLengths)            # index 0
    primalGraph.AddEmptyWeightMatrix()                  # index 1 - angles
    primalGraph.AddEmptyWeightMatrix(double_MaxValue);  # index 2 - steps
    primalGraph.AddEmptyWeightMatrix(double_MaxValue);  # index 3 - time
    
    for i in range(len(primalGraph.UndirectedEdges)):
        n1 = primalGraph.UndirectedEdges[i][0]  # start node of edge #i
        n2 = primalGraph.UndirectedEdges[i][1]  # end node of edge #i
    
        weight_1 = 0.0  # angle of a single edge is 0.0 deg 
        weight_2 = 0.0  # step of a single edge is 0 
    
        primalGraph.SetWeightMatrixAndEdgeValue(weight_1, n1, n2, 1)  # forward direction angles
        primalGraph.SetWeightMatrixAndEdgeValue(weight_1, n2, n1, 1)  # backward direction angles
        
        primalGraph.SetWeightMatrixAndEdgeValue(weight_2, n1, n2, 2)  # forward direction steps
        primalGraph.SetWeightMatrixAndEdgeValue(weight_2, n2, n1, 2)  # backward direction steps
        
        primalGraph.SetWeightMatrixAndEdgeValue(TimeWeightsIn[i], n1, n2, 3)  # forward direction time
        primalGraph.SetWeightMatrixAndEdgeValue(TimeWeightsOut[i], n2, n1, 3)  # backward direction time

# Create Dual Graph
if True:    
    # Get dual nodes and edges from primal graph
    graphElements, edgeLengths, edgeAngles = GeometryToGraphElements[rg.Point3d, rg.Line].GetDualNodesAndEdgesFromPrimalGraph(primalGraph)
    
    # Create the dual graph using the primal graph and dual graph elements
    dualGraph = CDualUndirectedGraph[rg.Point3d, rg.Line](primalGraph, graphElements)

    # The order of dual graph weight matrices must be the same as in the primal graph
    # Dual lengths
    dualGraph.AddWeightMatrix(edgeLengths)  # index 0
    # Dual angles
    dualGraph.AddWeightMatrix(edgeAngles)  # index 1
    
    dualGraph.AddEmptyWeightMatrix(double_MaxValue);      #index 2 - steps
    dualGraph.AddEmptyWeightMatrix(double_MaxValue);      #index 3 - time 
    
    # Calculate dual edge values for weight matrices #2 and #3
    for i in range(dualGraph.UndirectedEdges.Count):
        edge = dualGraph.UndirectedEdges[i]
        primDirEdgeId_0 = edge[0]
        primDirEdgeId_1 = edge[1]
    
        e0n1 = dualGraph.Nodes[primDirEdgeId_0].PrimId1  # primal node from of edge 0
        e0n2 = dualGraph.Nodes[primDirEdgeId_0].PrimId2  # primal node to of edge 0
    
        e1n1 = dualGraph.Nodes[primDirEdgeId_1].PrimId1   # primal node from of edge 1
        e1n2 = dualGraph.Nodes[primDirEdgeId_1].PrimId2   # primal node to of edge 1

        # Edge to opposite itself
        if e0n1 == e1n2:
            oppositePrimDirEdgeId_0 = primalGraph.GetOppositeEdgeId(primDirEdgeId_0)
            oppositePrimDirEdgeId_1 = primalGraph.GetOppositeEdgeId(primDirEdgeId_1)
            
            # index 2 - steps
            dualGraph.SetWeightMatrixAndEdgeValue(double_PositiveInfinity, primDirEdgeId_0, primDirEdgeId_1, 2)
            dualGraph.SetWeightMatrixAndEdgeValue(double_PositiveInfinity, oppositePrimDirEdgeId_1, oppositePrimDirEdgeId_0, 2)
    
            # index 3 - time 
            dualGraph.SetWeightMatrixAndEdgeValue(double_PositiveInfinity, primDirEdgeId_0, primDirEdgeId_1, 3)
            dualGraph.SetWeightMatrixAndEdgeValue(double_PositiveInfinity, oppositePrimDirEdgeId_1, oppositePrimDirEdgeId_0, 3)
            continue
    
        undirPrimDirEdgeId_0 = primalGraph.GetUndirectedEdgeId(primDirEdgeId_0)
        undirPrimDirEdgeId_1 = primalGraph.GetUndirectedEdgeId(primDirEdgeId_1)
        
        isEdgeLink_0 = EdgeIsLinkUndir[undirPrimDirEdgeId_0]
        isEdgeLink_1 = EdgeIsLinkUndir[undirPrimDirEdgeId_1]
    
        iEdgeIsActivityNodeLink_0 = EdgesIsActivityNodeLinkUndir[undirPrimDirEdgeId_0]
        iEdgeIsActivityNodeLink_1 = EdgesIsActivityNodeLinkUndir[undirPrimDirEdgeId_1]

        # 0 = normal segment
        # 1 = modal link
        # 2 = activity node link
    
        # start
        LinkType_0 = 0
    
        if isEdgeLink_0:
            LinkType_0 = 1
    
        if iEdgeIsActivityNodeLink_0:
            LinkType_0 = 2
    
        # end
        LinkType_1 = 0
    
        if isEdgeLink_1:
            LinkType_1 = 1
    
        if iEdgeIsActivityNodeLink_1:
            LinkType_1 = 2
     
        dualStepWeight = 0.00000001
    
        # step between two default segments
        # penalty based on the angular deviation between the segments and presence of crossings
        # if there is no crossing the penalty is 0. if there is a crossing and we have to turn more than 30 degrees from the original direction, the penalty is 1
        
        if LinkType_0 == 0 and LinkType_1 == 0:  
            angle = dualGraph.GetEdgeValue(i, 1)
            if angle > 30.0 and len(primalGraph.Nodes[e0n2].OutNeighbourEdges) > 2:
                dualStepWeight = 1.0
    
        # step between default segment and activity node link
        # penalty is 1000 (a link penalty to avoid internal shortcuts) + 1 (to count for one decision)
        if (LinkType_0 == 2 and LinkType_1 == 0) or (LinkType_1 == 2 and LinkType_0 == 0):
            dualStepWeight = 1 + 1000
    
        # step between activity node and modal link
        # penalty is 0.5 (modal penalty is always in entry-exit pairs, we use 0.5 so that the full modal change takes 1 decision) + 1000 (activity node penalty)
        if (LinkType_0 == 2 and LinkType_1 == 1) or (LinkType_1 == 2 and LinkType_0 == 1):
            dualStepWeight = 0.5 + 1000
    
        # step between activity node link and activity node link
        # penalty is 1000 (activity node penalty)
        if (LinkType_0 == 2 and LinkType_1 == 2):
            dualStepWeight = 1000 + 1000
    
        # step between modal link and modal link
        # penalty is 1, this is used when traveling through the internal network
        if (LinkType_0 == 1 and LinkType_1 == 1):
            dualStepWeight = 1
    
        # step between modal link and default segment
        # penalty is 0.5 (modal penalty is always in entry-exit pairs, we use 0.5 so that the full modal change takes 1 decision)
        if (LinkType_0 == 1 and LinkType_1 == 0) or (LinkType_1 == 1 and LinkType_0 == 0):
            dualStepWeight = 0.5
    
        dualGraph.SetWeightMatrixAndEdgeValue(dualStepWeight, primDirEdgeId_0, primDirEdgeId_1, 2)  # index 2 - steps
        dualGraph.SetWeightMatrixAndEdgeValue(dualStepWeight, primalGraph.GetOppositeEdgeId(primDirEdgeId_1), primalGraph.GetOppositeEdgeId(primDirEdgeId_0), 2)
    
        dualEdgeTimeWeight1 = (primalGraph.GetEdgeValue(primDirEdgeId_0, 3) + primalGraph.GetEdgeValue(primDirEdgeId_1, 3)) / 2.0
        dualEdgeTimeWeight2 = (primalGraph.GetEdgeValue(primalGraph.GetOppositeEdgeId(primDirEdgeId_1), 3) + primalGraph.GetEdgeValue(primalGraph.GetOppositeEdgeId(primDirEdgeId_0), 3)) / 2.0
    
        dualGraph.SetWeightMatrixAndEdgeValue(dualEdgeTimeWeight1, primDirEdgeId_0, primDirEdgeId_1, 3)  # index 3 - time
        dualGraph.SetWeightMatrixAndEdgeValue(dualEdgeTimeWeight2, primalGraph.GetOppositeEdgeId(primDirEdgeId_1), primalGraph.GetOppositeEdgeId(primDirEdgeId_0), 3)
    
    
# Calculate shortest paths
dualGraph.APShortestPathsByManyWeights(WeightMatrixIndexMain, WeightMatrixIndexFilter, GPU, 0.0000000001)
#dualGraph.APShortestPathsByOneWeight(WeightMatrixIndexMain, GPU) 

 
# Calculate all other Weight Matrices, which are not WeightMatrixIndexMain
allIds = list(range(len(dualGraph.weightMatrices)))
otherMatricesIds = [i for i in allIds if i != WeightMatrixIndexMain]
dualGraph.FillWeightMatrixBySPRestore(Array[int](otherMatricesIds), GPU)
    
DualGraph = dualGraph
# ---------- end python_f14_dual_graph_cognitive_distance ----------
dualgraph = ClusterOutput(python_f14_dual_graph_cognitive_distance.DualGraph)

# ==== cluster ClusterPythonF2PrimalDirectedGraph
usefiltermatrix = ClusterInput()
gpu = ClusterInput()
libpathgrafit = ClusterInput()
libpathgrafitrhino = ClusterInput()
linegeometry = ClusterInput()
edgeweightsforward = ClusterInput()
edgeweightsbackward = ClusterInput()
weightmatrixindexmain = ClusterInput()
weightmatrixindexfilter = ClusterInput()
calculateallmatrices = ClusterInput()
python_f2_primal_directed_graph = GhPythonScript(
    LibPathGrafit=libpathgrafit,
    LibPathGrafitRhino=libpathgrafitrhino,
    LineGeometry=linegeometry,
    EdgeWeightsForward=edgeweightsforward,
    EdgeWeightsBackward=edgeweightsbackward,
    WeightMatrixIndexMain=weightmatrixindexmain,
    WeightMatrixIndexFilter=weightmatrixindexfilter,
    CalculateAllMatrices=calculateallmatrices,
    UseFilterMatrix=usefiltermatrix,
    GPU=gpu)  # -> out, PrimalDirGraph; inputs LineGeometry: list of Line, EdgeWeightsForward: list, EdgeWeightsBackward: list, WeightMatrixIndexMain: Int32, WeightMatrixIndexFilter: Int32, CalculateAllMatrices: Boolean, UseFilterMatrix: Boolean, GPU: Boolean
# ---------- python_f2_primal_directed_graph: Python ----------
import rhinoscriptsyntax as rs
import Rhino.Geometry as rg
import sys
import clr

clr.AddReference("Grafit") 
clr.AddReference("GrafitRhino")  

#clr.AddReferenceToFile(LibPathGrafit)
#clr.AddReferenceToFile(LibPathGrafitRhino)  

from Grafit import *
from GrafitRhino import *
from System import Array

primalGraph = {} 


#Create Primal Graph 
lineGeometry = Array[CWLine](map(lambda s: CWLine(s), LineGeometry))

graphElements, edgeLengths = GeometryToGraphElements[rg.Point3d, rg.Line].GetNodesAndEdgesFromLines(lineGeometry)

primalGraph = CPrimalDirectedGraph[rg.Point3d, rg.Line](graphElements)
primalGraph.AddWeightMatrix(edgeLengths)    # index 0
primalGraph.AddEmptyWeightMatrix()          # index 1  

for i in range(len(primalGraph.UndirectedEdges)):
    n1 = primalGraph.UndirectedEdges[i][0]  # start node of edge #i
    n2 = primalGraph.UndirectedEdges[i][1]  # end node of edge #i
 
    weight_matrix_id = 1

    primalGraph.SetWeightMatrixAndEdgeValue(EdgeWeightsForward[i], n1, n2, weight_matrix_id)  # forward direction
    primalGraph.SetWeightMatrixAndEdgeValue(EdgeWeightsBackward[i], n2, n1, weight_matrix_id)  # backward direction 

if UseFilterMatrix:
  primalGraph.APShortestPathsByManyWeights(WeightMatrixIndexMain, WeightMatrixIndexFilter, GPU);
else:
  primalGraph.APShortestPathsByOneWeight(WeightMatrixIndexMain, GPU);
 
# If graph has more than 1 weight matrix, calculate distances along shortest paths according to all other weights
if CalculateAllMatrices:
    # Select which weights are needed to measure shortest paths
    # By default, all other matrices which are not the main are selected
    allIds = list(range(len(primalGraph.weightMatrices)))
    otherMatricesIds = [i for i in allIds if i != WeightMatrixIdxMain]
    primalGraph.FillWeightMatrixBySPRestore(otherMatricesIds, GPU)
    
PrimalDirGraph = primalGraph
# ---------- end python_f2_primal_directed_graph ----------
primaldirgraph = ClusterOutput(python_f2_primal_directed_graph.PrimalDirGraph)

# ==== cluster ClusterPythonF3GetShortestPaths
libpathgrafit = ClusterInput()
libpathgrafitrhino = ClusterInput()
graph = ClusterInput()
origin = ClusterInput()
destination = ClusterInput()
usedirectededges = ClusterInput()
python_f3_get_shortest_paths = GhPythonScript(
    LibPathGrafit=libpathgrafit,
    LibPathGrafitRhino=libpathgrafitrhino,
    Graph=graph,
    Origin=origin,
    Destination=destination,
    UseDirectedEdges=usedirectededges)  # -> out, NodesPath, EdgesPath, Distances; inputs Origin: Int32, Destination: Int32, UseDirectedEdges: Boolean
# ---------- python_f3_get_shortest_paths: Python ----------
import rhinoscriptsyntax as rs
import Rhino.Geometry as rg
import sys
import clr

clr.AddReference("Grafit") 
clr.AddReference("GrafitRhino")  

#clr.AddReferenceToFile(LibPathGrafit)
#clr.AddReferenceToFile(LibPathGrafitRhino)  

from Grafit import *
from GrafitRhino import *
from System import Array
 

NodesPath, EdgesPath = Graph.GetShortestPathNodeAndEdgeIds(Origin, Destination, UseDirectedEdges) 

wmc = len(Graph.weightMatrices)

Distances = []
for i in range(wmc):
    Distances.append(Graph.GetShortestPathDistance(Origin, Destination, i))
# ---------- end python_f3_get_shortest_paths ----------
nodespath = ClusterOutput(python_f3_get_shortest_paths.NodesPath)
edgespath = ClusterOutput(python_f3_get_shortest_paths.EdgesPath)
distances = ClusterOutput(python_f3_get_shortest_paths.Distances)

# ==== cluster ClusterPythonF11GetAlternativePaths
libpathgrafit = ClusterInput()
libpathgrafitrhino = ClusterInput()
graph = ClusterInput()
origin = ClusterInput()
destination = ClusterInput()
weightids = ClusterInput()
weighttolerance = ClusterInput()
limit = ClusterInput()
python_f11_get_alternative_paths = GhPythonScript(
    LibPathGrafit=libpathgrafit,
    LibPathGrafitRhino=libpathgrafitrhino,
    Graph=graph,
    Origin=origin,
    Destination=destination,
    WeightIds=weightids,
    WeightTolerance=weighttolerance,
    Limit=limit)  # -> out, NodesPath, EdgesPath; inputs Origin: Int32, Destination: Int32, WeightIds: list of Int32, WeightTolerance: list, Limit: Int32
# ---------- python_f11_get_alternative_paths: Python ----------
import rhinoscriptsyntax as rs
import Rhino.Geometry as rg
import sys
import clr

clr.AddReference("Grafit") 
clr.AddReference("GrafitRhino")  

#clr.AddReferenceToFile(LibPathGrafit)
#clr.AddReferenceToFile(LibPathGrafitRhino)  

from Grafit import *
from GrafitRhino import *
from System import Array

from Grasshopper import DataTree
from Grasshopper.Kernel.Data import GH_Path 

NodesPath, EdgesPath = Graph.AlternativeShortestPaths(Origin, Destination, Array[int](WeightIds), Array[float](WeightTolerance), Limit, True, False)

nodesPathTree = DataTree[int]()
edgesPathTree = DataTree[int]()

for i in range(len(NodesPath)):
    nodesPathTree.AddRange(NodesPath[i], GH_Path(i))
    edgesPathTree.AddRange(EdgesPath[i], GH_Path(i))
 

NodesPath = nodesPathTree;
EdgesPath = edgesPathTree;
# ---------- end python_f11_get_alternative_paths ----------
nodespath = ClusterOutput(python_f11_get_alternative_paths.NodesPath)
edgespath = ClusterOutput(python_f11_get_alternative_paths.EdgesPath)

# ==== cluster ClusterPythonF4GenerateGeometry
libpathgrafitrhino = ClusterInput()
libpathgrafit = ClusterInput()
graph = ClusterInput()
python_f4_generate_geometry = GhPythonScript(LibPathGrafit=libpathgrafit, LibPathGrafitRhino=libpathgrafitrhino, Graph=graph)  # -> out, NodeAsPoints, EdgesDirected, EdgesUndirected
# ---------- python_f4_generate_geometry: Python ----------
import rhinoscriptsyntax as rs
import Rhino.Geometry as rg
import sys
import clr

clr.AddReference("System.Core")
clr.AddReference("Grafit") 
clr.AddReference("GrafitRhino")  

#clr.AddReferenceToFile(LibPathGrafit)
#clr.AddReferenceToFile(LibPathGrafitRhino)  
from System.Linq import *
from Grafit import *
from GrafitRhino import *
from System import Array

graph = Graph 

if isinstance(Graph, CDualUndirectedGraph[rg.Point3d, rg.Line]): 
    graph = Graph.PrimalDirectedGraph

NodeAsPoints = [s.Internal for s in Enumerable.Select(graph.NodesGeometryList, lambda s: s)]
EdgesDirected = [s.Internal for s in Enumerable.Select(graph.GenerateDirectedEdgeGeometry(CWLine.LineFromPoints), lambda s: s)]
EdgesUndirected = [s.Internal for s in Enumerable.Select(graph.GenerateUndirectedEdgeGeometry(CWLine.LineFromPoints), lambda s: s)]
# ---------- end python_f4_generate_geometry ----------
nodeaspoints = ClusterOutput(python_f4_generate_geometry.NodeAsPoints)
edgesdirected = ClusterOutput(python_f4_generate_geometry.EdgesDirected)
edgesundirected = ClusterOutput(python_f4_generate_geometry.EdgesUndirected)

# ==== cluster ClusterPythonF5GetWeightMatrixAsMatrix
libpathgrafit = ClusterInput()
libpathgrafitrhino = ClusterInput()
graph = ClusterInput()
from = ClusterInput()
to = ClusterInput()
weightmatrixindex = ClusterInput()
python_f5_get_weight_matrix_as_matrix = GhPythonScript(
    LibPathGrafit=libpathgrafit,
    LibPathGrafitRhino=libpathgrafitrhino,
    Graph=graph,
    From=from,
    To=to,
    WeightMatrixIndex=weightmatrixindex)  # -> out, DistanceMatrix; inputs From: list of Int32, To: list of Int32, WeightMatrixIndex: Int32
# ---------- python_f5_get_weight_matrix_as_matrix: Python ----------
import rhinoscriptsyntax as rs
import Rhino.Geometry as rg
import sys
import clr

clr.AddReference("System.Core")
clr.AddReference("Grafit") 
clr.AddReference("GrafitRhino")  

#clr.AddReferenceToFile(LibPathGrafit)
#clr.AddReferenceToFile(LibPathGrafitRhino)  
from System.Linq import *
from Grafit import *
from GrafitRhino import * 

#Get Weight Matrix As Rhino Matrix Object 
dm = Graph.GetWeigthMatrixById(WeightMatrixIndex);

result = GrafitRhinoUtils.Get1DDoubleArrayAsMatrix(dm);

FromN = len(From);
ToN = len(To);

DistanceMatrix = rg.Matrix(FromN, ToN);

for i in range(FromN):
    for j in range(ToN):
        weight = result[From[i], To[j]]
        DistanceMatrix[i, j] = weight
# ---------- end python_f5_get_weight_matrix_as_matrix ----------
distancematrix = ClusterOutput(python_f5_get_weight_matrix_as_matrix.DistanceMatrix)

# ==== cluster ClusterPythonF7CalculateBCAndCC
libpathgrafit = ClusterInput()
libpathgrafitrhino = ClusterInput()
graph = ClusterInput()
from = ClusterInput()
to = ClusterInput()
odweightmatrixreduced = ClusterInput()
usedirectededges = ClusterInput()
calculatebc = ClusterInput()
calculatecc = ClusterInput()
ccweightmatrixid = ClusterInput()
gpu = ClusterInput()
python_f7_calculate_bc_and_cc = GhPythonScript(
    LibPathGrafit=libpathgrafit,
    LibPathGrafitRhino=libpathgrafitrhino,
    Graph=graph,
    From=from,
    To=to,
    ODWeightMatrixReduced=odweightmatrixreduced,
    UseDirectedEdges=usedirectededges,
    CalculateBC=calculatebc,
    CalculateCC=calculatecc,
    CCWeightMatrixId=ccweightmatrixid,
    GPU=gpu)  # -> out, BCN, BCE, CCN, CCE; inputs From: list of Int32, To: list of Int32, UseDirectedEdges: Boolean, CalculateBC: Boolean, CalculateCC: Boolean, CCWeightMatrixId: Int32, GPU: Boolean
# ---------- python_f7_calculate_bc_and_cc: Python ----------
import rhinoscriptsyntax as rs
import Rhino.Geometry as rg
import sys
import clr

clr.AddReference("System.Core")
clr.AddReference("Grafit") 
clr.AddReference("GrafitRhino")  

#clr.AddReferenceToFile(LibPathGrafit)
#clr.AddReferenceToFile(LibPathGrafitRhino)  
from System.Linq import *
from Grafit import *
from GrafitRhino import * 
from System import Array

n = Graph.NodesCountMeasure

odRhinoMatrix = ODWeightMatrixReduced  # Assuming ODWeightMatrixReduced is a valid matrix

odwm = Array[float]([0.0] * (n * n))    # Initialize a list filled with 0s

for i in range(len(From)):
    for j in range(len(To)):
        odwm[From[i] * n + To[j]] = ODWeightMatrixReduced[i, j]

measurement = CMeasure(Graph)
measurement.UseDirectedEdges = UseDirectedEdges

CCN = None
CCE = None
BCN = None
BCE = None

if CalculateBC:
    measurement.CalculateBC(odwm, GPU)
    BCN = measurement.BCNodes
    BCE = measurement.BCEdges

if CalculateCC:
    measurement.CalculateCC(odwm, CCWeightMatrixId, GPU)
    CCN = measurement.CCNodes
    CCE = measurement.CCEdges

result = [BCN, BCE, CCN, CCE]
# ---------- end python_f7_calculate_bc_and_cc ----------
bcn = ClusterOutput(python_f7_calculate_bc_and_cc.BCN)
bce = ClusterOutput(python_f7_calculate_bc_and_cc.BCE)
ccn = ClusterOutput(python_f7_calculate_bc_and_cc.CCN)
cce = ClusterOutput(python_f7_calculate_bc_and_cc.CCE)

# ==== cluster ClusterPythonF13Isovist3DGPU
libpathgrafit = ClusterInput()
libpathgrafitrhino = ClusterInput()
vp = ClusterInput()
os = ClusterInput()
gs = ClusterInput()
vd = ClusterInput()
vr = ClusterInput()
hva = ClusterInput()
vva = ClusterInput()
hpr = ClusterInput()
vpr = ClusterInput()
vao = ClusterInput()
ohp = ClusterInput()
python_f13_isovist_3d_gpu = GhPythonScript(
    LibPathGrafit=libpathgrafit,
    LibPathGrafitRhino=libpathgrafitrhino,
    VP=vp,
    OS=os,
    GS=gs,
    VD=vd,
    VR=vr,
    HVA=hva,
    VVA=vva,
    HPr=hpr,
    VPr=vpr,
    VAO=vao,
    OHP=ohp)  # -> out, HitPoints, flatten(MeshIdsPerRay), NumberOfRays; inputs VP: list of Point3d, OS: list of Mesh, GS: list of Mesh, VD: list of Vector3d, OHP: Boolean
# ---------- python_f13_isovist_3d_gpu: Python ----------
import rhinoscriptsyntax as rs
import Rhino.Geometry as rg
import sys
import clr

clr.AddReference("System.Core")
clr.AddReference("Grafit") 
clr.AddReference("GrafitRhino")   

#clr.AddReferenceToFile(LibPathGrafit)
#clr.AddReferenceToFile(LibPathGrafitRhino)  
from System.Linq import *
from Grafit import *
from GrafitRhino import * 
from System import *
from System.Collections.Generic import List

isovist = CIsovist(
  List[rg.Point3d](VP) ,
  List[rg.Mesh](OS),
  List[rg.Mesh](GS),
  List[rg.Vector3d](VD), 
  VR, HVA,
  VVA,
  HPr, VPr, VAO);

if OHP:
    HitPoints = isovist.hits

MeshIdsPerRay = isovist.surfaceToRaysList
NumberOfRays = isovist.NumberOfRaysPerPoint
# ---------- end python_f13_isovist_3d_gpu ----------
hitpoints = ClusterOutput(python_f13_isovist_3d_gpu.HitPoints)
meshidsperray = ClusterOutput(python_f13_isovist_3d_gpu.MeshIdsPerRay)
numberofrays = ClusterOutput(python_f13_isovist_3d_gpu.NumberOfRays)

# ==== cluster ClusterPythonF12CalculatePathVisibility
libpathgrafit = ClusterInput()
libpathgrafitrhino = ClusterInput()
graph = ClusterInput()
from = ClusterInput()
to = ClusterInput()
odweightmatrixreduced = ClusterInput()
directed = ClusterInput()
meshidsperray = ClusterInput()
edgetovantagepoints = ClusterInput()
brepscount = ClusterInput()
gpu = ClusterInput()
python_f12_calculate_path_visibility = GhPythonScript(
    LibPathGrafit=libpathgrafit,
    LibPathGrafitRhino=libpathgrafitrhino,
    Graph=graph,
    From=from,
    To=to,
    ODWeightMatrixReduced=odweightmatrixreduced,
    Directed=directed,
    MeshIdsPerRay=meshidsperray,
    EdgeToVantagePoints=edgetovantagepoints,
    BrepsCount=brepscount,
    GPU=gpu)  # -> out, V; inputs From: list of Int32, To: list of Int32, Directed: Boolean, MeshIdsPerRay: list of Int32, EdgeToVantagePoints: tree of Int32, BrepsCount: Int32, GPU: Boolean
# ---------- python_f12_calculate_path_visibility: Python ----------
import rhinoscriptsyntax as rs
import Rhino.Geometry as rg
import sys
import clr

clr.AddReference("System.Core")
clr.AddReference("Grafit") 
clr.AddReference("GrafitRhino")   

#clr.AddReferenceToFile(LibPathGrafit)
#clr.AddReferenceToFile(LibPathGrafitRhino)  
from System.Linq import *
from Grafit import *
from GrafitRhino import * 
from System import *
from System.Collections.Generic import List, Dictionary

EdgeToVantagePointsDict = {} 

for i in range(EdgeToVantagePoints.BranchCount):
    EdgeToVantagePointsDict[i] = List[int](EdgeToVantagePoints.Branches[i])
    
 
n = Graph.NodesCountMeasure 
odwm = Array[float]([0.0] * (n * n))  # Initialize a list filled with 0s

for i in range(len(From)):
    for j in range(len(To)):
        odwm[From[i] * n + To[j]] = ODWeightMatrixReduced[i, j]

measurement = CMeasure(Graph)
measurement.UseDirectedEdges = Directed

V = measurement.CalculateBCVisibility(odwm, Array[int](MeshIdsPerRay), Dictionary[int, List[int]](EdgeToVantagePointsDict), BrepsCount)
# ---------- end python_f12_calculate_path_visibility ----------
V = ClusterOutput(python_f12_calculate_path_visibility.V)

# ==== cluster ClusterPythonF10DisconnectedParts
libpathgrafit = ClusterInput()
libpathgrafitrhino = ClusterInput()
graph = ClusterInput()
python_f10_disconnectedparts = GhPythonScript(LibPathGrafit=libpathgrafit, LibPathGrafitRhino=libpathgrafitrhino, Graph=graph)  # -> out, Subgraphs
# ---------- python_f10_disconnectedparts: Python ----------
import rhinoscriptsyntax as rs
import Rhino.Geometry as rg
import sys
import clr

clr.AddReference("System.Core")
clr.AddReference("Grafit") 
clr.AddReference("GrafitRhino")  

#clr.AddReferenceToFile(LibPathGrafit)
#clr.AddReferenceToFile(LibPathGrafitRhino)  
from System.Linq import *
from Grafit import *
from GrafitRhino import *
from System import Array

from Grasshopper import DataTree
from Grasshopper.Kernel.Data import GH_Path 

graph = Graph 

if isinstance(Graph, CDualUndirectedGraph[rg.Point3d, rg.Line]): 
    graph = Graph.PrimalDirectedGraph

subgraphsList = graph.GetDisconnectedParts()

tree = DataTree[int]()   
 
for i in range(subgraphsList.Count): 
    tree.AddRange(subgraphsList[i], GH_Path(i));

Subgraphs = tree;
# ---------- end python_f10_disconnectedparts ----------
subgraphs = ClusterOutput(python_f10_disconnectedparts.Subgraphs)
