# Grasshopper definition GraFit Network Components Example.gh (Grasshopper 1.0.7)
# plug-ins: Human, GraFitNodes

# ---- group: Test Network Geometry
crv_random_network_s = Curve([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])
crv_random_network_l = Curve([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])
crv_regular_grid = Curve([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])

# ----
gridgrid = Curve([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])
explode = Explode(Curve=gridgrid, Recursive=True)  # -> flatten(Segments), Vertices
line = Line(flatten(explode.Segments))
number_slider = Slider(1, range=0..1)
number_slider_2 = Slider(0, range=0..1)
number_slider_3 = Slider(1, range=0..1)
toggle = BooleanToggle(True)
lng = ListLength(List=graft(line))  # -> expr("x*1", flatten(Length))
lng_2 = ListLength(List=graft(line))  # -> expr("x*1", flatten(Length))
buildgraph = BuildGraph(
    Lines=line,
    CustomWeightsForward=lng,
    CustomWeightsBackward=lng,
    LengthCoefficient=number_slider_3,
    AngleCoefficient=number_slider,
    CustomCoefficient=number_slider_2,
    GPU=toggle,
    All=True)  # -> Graph, Nodes, Edges
buildfloatgraph = BuildFloatGraph(
    Lines=line,
    CustomWeightsForward=lng,
    CustomWeightsBackward=lng,
    LengthCoefficient=number_slider_3,
    AngleCoefficient=number_slider,
    CustomCoefficient=number_slider_2,
    GPU=toggle)  # -> Graph, Nodes, Edges; disabled
buildgraph_2 = BuildGraph(
    Lines=line,
    CustomWeightsForward=lng_2,
    CustomWeightsBackward=lng_2,
    LengthCoefficient=Slider(1, range=0..1),
    AngleCoefficient=Slider(1, range=0..1),
    CustomCoefficient=Slider(1, range=0..1),
    GPU=Toggle(True),
    All=True)  # -> Graph, Nodes, Edges
all_nodes_geometry = Point(buildgraph.Nodes)
number_slider_4 = Slider(0, range=0..3)
panel = Panel("""0
19
1""")
panel_2 = Panel("""10
9
11
26
22""")
c_all_nodes_ids = CSharpScript(nodes=all_nodes_geometry)  # -> out, A; inputs nodes: list of Int32
# ---------- c_all_nodes_ids: C# usings ----------
using System.Linq;
# ---------- c_all_nodes_ids: C# ----------
    A = nodes.Select((s, i) => i);
# ---------- end c_all_nodes_ids ----------
destination_list = Integer(panel_2)
origins_list = Integer(panel)

# ----
# Set Radius in meters
# (0 = Radius ∞)
index_0_metric_matrix = Panel("1")
getdistancematrix = GetDistanceMatrix(Graph=buildgraph_2.Graph, DistanceMatrixIndex=index_0_metric_matrix, Origins=origins_list, Destinations=destination_list)
c_filter_by_radius = CSharpScript(M=getdistancematrix, Radius=Slider(0, range=0..3400))  # -> out, A; inputs Radius: Double; disabled
# ---------- c_filter_by_radius: C# ----------
    var sourceMatrix = (Matrix) M;
    var filteredMatrix = new Matrix(sourceMatrix.ColumnCount, sourceMatrix.ColumnCount);

    if(Radius <= 0)
    {
      Radius = double.MaxValue;
    }



    for(int i = 0; i < sourceMatrix.ColumnCount; i++)
    {
      for(int j = 0; j < sourceMatrix.ColumnCount; j++)
      {
        filteredMatrix[i, j] = 0;

        if(sourceMatrix[i, j] <= Radius)
          filteredMatrix[i, j] = 1;
      }
    }

    A = filteredMatrix;
# ---------- c_filter_by_radius: C# additional code ----------
  //Return a BoundingBox that contains all the geometry you are about to draw.
  public override BoundingBox ClippingBox
  {
    get
    {
      return BoundingBox.Empty;
    }
  }

  //Draw all meshes in this method.
  public override void DrawViewportMeshes(IGH_PreviewArgs args)
  {
  }

  //Draw all wires and points in this method.
  public override void DrawViewportWires(IGH_PreviewArgs args)
  {
  }
# ---------- end c_filter_by_radius ----------

segment_lenght_2_nodes = SegmentLenght2Nodes(graph=buildgraph_2.Graph, graph_edges=buildgraph_2.Edges, graph_nodes=buildgraph_2.Nodes)
toggle_2 = BooleanToggle(True)
number_slider_5 = Slider(0, range=0..100)
getdistancematrix_2 = GetDistanceMatrix(Graph=buildgraph.Graph, DistanceMatrixIndex=number_slider_4)
getdistancematrix_3 = GetDistanceMatrix(Graph=buildgraph.Graph, DistanceMatrixIndex=number_slider_4, Origins=buildgraph_2.Nodes, Destinations=buildgraph_2.Nodes)
panel_3 = Panel("""0
1
40
41
2""")
node_ids = Panel("""2
6
8""")
edge_ids = Panel("""26
12""")
branch = TreeBranch(Tree=buildgraph.Edges, Path="{0}", MaintainPaths=True)
dematrix = DeconstructMatrix(Matrix=getdistancematrix_3)  # -> Rows, Columns, Values
dematrix_2 = DeconstructMatrix(Matrix=getdistancematrix_2)  # -> Rows, Columns, Values
destination = Point(Point(-40.04331757, -80.00869601, 0))
origin = Point(Point(-42.98338245, -76.45419682, 0))
origin_2 = Point(Point(-42.03300304, -76.44023645, 0))
panel_4 = Panel(dematrix.Values)
int = Integer(Slider(0, range=0..100))
int_2 = Integer(Slider(2, range=0..100))
# Slightly offseted edges for visualisation
c_move = CSharpScript(directedEdges=flatten(buildgraph.Edges))  # -> out, A; inputs directedEdges: list of Line
# ---------- c_move: C# ----------
    var lines = directedEdges.Take(directedEdges.Count() / 2).ToList();
    var translatedLines = new Line[lines.Count * 2];
    int index = 0;
    double distance = 0.05;



    foreach (Line line in lines)
    {
      Point3d midpoint = line.PointAt(0.5);
      Vector3d tangent = line.UnitTangent;
      Vector3d normal = Vector3d.CrossProduct(tangent, Vector3d.ZAxis);
      normal *= distance;
      Point3d start = line.From + normal;
      Point3d end = line.To + normal;
      Line translatedLine = new Line(start, end);

      translatedLines[index] = new Line(start, end);
      index++;
    }

    foreach (Line line in lines)
    {
      line.Flip();
      Point3d midpoint = line.PointAt(0.5);
      Vector3d tangent = line.UnitTangent;
      Vector3d normal = Vector3d.CrossProduct(tangent, Vector3d.ZAxis);
      normal *= distance;
      Point3d start = line.From + normal;
      Point3d end = line.To + normal;
      Line translatedLine = new Line(start, end);

      translatedLines[index] = new Line(start, end);
      index++;
    }


    A = translatedLines;
# ---------- end c_move ----------
panel_5 = Panel(dematrix_2.Values)
item = ListItem(List=buildgraph.Nodes, Index=panel_3, Wrap=True)
undirectededges = Line(branch)
getgraphavgcc = GetGraphAvgCC(Graph=buildgraph_2.Graph, DistanceMatrixIndex="0")  # -> CCN, CCE, CCEDSum, CCEPSum, CCNDSum, CCNPSum; disabled
all_nodes_geometry_2 = Point(buildgraph.Nodes)
getgraphavgccnodew = GetGraphAvgCCNodeW(Graph=buildgraph.Graph, DistanceMatrixIndex="0", ODWeightMatrix=c_filter_by_radius.A, NodeWeights=segment_lenght_2_nodes)  # -> CCN, CCE, CCEDSum, CCEPSum, CCNDSum, CCNPSum
getedgesbynode = GetEdgesByNode(Graph=buildgraph.Graph, NodeId=node_ids)
getnodesbyedge = GetNodesByEdge(Graph=buildgraph.Graph, EdgeId=edge_ids)
getgraphgeometry = GetGraphGeometry(Graph=buildgraph.Graph)  # -> Nodes, Edges
getshortestpath = GetShortestPath(Graph=buildgraph.Graph, Origin=origin, Destination=destination)  # -> Metric, Angle, Custom, Aggregated, Nodes, Edges
getshortestpath_2 = GetShortestPath(Graph=buildgraph.Graph, Origin=origin_2, Destination=destination)  # -> Metric, Angle, Custom, Aggregated, Nodes, Edges
getshortestpath_3 = GetShortestPath(Graph=buildgraph.Graph, Origin=int, Destination=int_2)  # -> Metric, Angle, Custom, Aggregated, Nodes, Edges
getgraphbc = GetGraphBC(
    Graph=buildgraph.Graph,
    ODWeightMatrix=flatten(getdistancematrix_3),
    Origins=buildgraph_2.Nodes,
    Destinations=buildgraph_2.Nodes,
    GPU=toggle_2)  # -> BCN, BCE
getgraphbc_2 = GetGraphBC(Graph=buildgraph.Graph, ODWeightMatrix=flatten(getdistancematrix_2), GPU=toggle_2)  # -> BCN, BCE
panel_6 = Panel(getshortestpath_3.Angle)
panel_7 = Panel("""63
64""")
panel_8 = Panel(getshortestpath.Angle)
panel_9 = Panel(getshortestpath_2.Angle)
expression = Expression(distSum=getgraphavgccnodew.CCEDSum, pathCount=getgraphavgccnodew.CCEPSum, Expression="(pathCount^2.6) / distSum")
expression_2 = Expression(distSum=getgraphavgccnodew.CCNDSum, pathCount=getgraphavgccnodew.CCNPSum, Expression="(pathCount^2.6) / distSum")
panel_10 = Panel(getgraphavgccnodew.CCEPSum)
item_2 = ListItem(List=getgraphavgccnodew.CCEDSum, Index=panel_7, Wrap=True)
panel_11 = Panel(getgraphbc_2.BCE)
panel_12 = Panel(getgraphbc.BCE)
panel_13 = Panel(item_2)

# ---- group: Shortest Path
node_points_ids = Data(getshortestpath.Nodes)
edge_lines_ids = Data(getshortestpath.Edges)
swatch = ColourSwatch(SwatchColor=RGB(84, 199, 116))
item_3 = ListItem(List=flatten(buildgraph.Edges), Index=edge_lines_ids, Wrap=True)
item_4 = ListItem(List=all_nodes_geometry_2, Index=node_points_ids, Wrap=True)
symsim = SymbolSimple(Style=7, Size=12, Rotation=0, Colour=swatch)
symbol = SymbolDisplay(Location=item_4, Display=symsim)
previewlw = CustomPreviewLineweights(Geometry=item_3, Shader=swatch, Thickness=Slider(5, range=0..10), Absolute=False)

# ---- group: Edges By Node Id
node_points_ids_2 = Data(node_ids)
edge_lines_ids_2 = Data(getedgesbynode)
swatch_2 = ColourSwatch(SwatchColor=RGB(247, 255, 0))
item_5 = ListItem(List=flatten(c_move.A), Index=edge_lines_ids_2, Wrap=True)
item_6 = ListItem(List=all_nodes_geometry_2, Index=node_points_ids_2, Wrap=True)
symsim_2 = SymbolSimple(Style=7, Size=12, Rotation=0, Colour=swatch_2)
symbol_2 = SymbolDisplay(Location=item_6, Display=symsim_2)
previewlw_2 = CustomPreviewLineweights(Geometry=item_5, Shader=swatch_2, Thickness=Slider(5, range=0..10), Absolute=False)

# ---- group: Nodes by Edge Id
node_points_ids_3 = Data(getnodesbyedge)
edge_lines_ids_3 = Data(edge_ids)
swatch_3 = ColourSwatch(SwatchColor=RGB(0, 255, 234))
item_7 = ListItem(List=flatten(c_move.A), Index=edge_lines_ids_3, Wrap=True)
item_8 = ListItem(List=all_nodes_geometry_2, Index=node_points_ids_3, Wrap=True)
symsim_3 = SymbolSimple(Style=7, Size=12, Rotation=0, Colour=swatch_3)
symbol_3 = SymbolDisplay(Location=item_8, Display=symsim_3)
previewlw_3 = CustomPreviewLineweights(Geometry=item_7, Shader=swatch_3, Thickness=Slider(5, range=0..10), Absolute=False)

# ---- group: Shortest Path
node_points_ids_4 = Data(getshortestpath_2.Nodes)
edge_lines_ids_4 = Data(getshortestpath_2.Edges)
swatch_4 = ColourSwatch(SwatchColor=RGB(0, 255, 234))
item_9 = ListItem(List=flatten(buildgraph.Edges), Index=edge_lines_ids_4, Wrap=True)
item_10 = ListItem(List=all_nodes_geometry_2, Index=node_points_ids_4, Wrap=True)
symsim_4 = SymbolSimple(Style=7, Size=12, Rotation=0, Colour=swatch_4)
symbol_4 = SymbolDisplay(Location=item_10, Display=symsim_4)
previewlw_4 = CustomPreviewLineweights(Geometry=item_9, Shader=swatch_4, Thickness=Slider(5, range=0..10), Absolute=False)

# ----
branch_2 = TreeBranch(Tree=expression_2, Path="{0}", MaintainPaths=True)
branch_3 = TreeBranch(Tree=expression, Path="{0; 0}", MaintainPaths=True)
branch_4 = TreeBranch(Tree=expression, Path="{0; 1}", MaintainPaths=True)

# ---- group: Show Weights
eval = EvaluateCurve(Curve=undirectededges, Parameter=Slider(0.5, range=0..1))  # -> Point, Tangent, Angle

# ---- group: Nodes
values_nodes = Number(branch_2)
log = Logarithm(Value=values_nodes)
bnd = Bounds(Numbers=log)
remap = RemapNumbers(Value=log, Source=bnd, Target=Domain(0, 1))  # -> Mapped, Clipped
gradient = Gradient(
    LowerLimit=0,
    UpperLimit=1,
    Parameter=remap.Mapped,
    stops=[0: RGB(0, 0, 139), 0.221: RGB(50, 178, 206), 0.709: RGB(255, 215, 0), 1: RGB(255, 0, 0)])
symsim_5 = SymbolSimple(Style=5, Size=Slider(6, range=0..10), Rotation=0, Colour=gradient)
symbol_5 = SymbolDisplay(Location=all_nodes_geometry_2, Display=symsim_5)

# ---- group: Path as vectors
item_11 = ListItem(List=flatten(buildgraph.Edges), Index=edge_lines_ids, Wrap=True)
end = EndPoints(Curve=item_11)  # -> Start, End
vdis = VectorDisplay(Anchor=end.Start, Vector=item_11)

# ---- group: Show Ids
number_slider_6 = Slider(0.3, range=0..1)
number_slider_7 = Slider(0.07, range=0..1.1)
eval_2 = EvaluateCurve(Curve=c_move.A, Parameter=Slider(0.5, range=0..1))  # -> Point, Tangent, Angle

# ---- group: Show Ids / Edges
points = PointList(Points=eval_2.Point, Size=number_slider_7)

# ---- group: Show Ids / Nodes
points_2 = PointList(Points=all_nodes_geometry_2, Size=number_slider_6)

# ----
undirectededges_2 = Line(undirectededges)

# ---- group: Edges
addition = Addition(A=branch_3, B=branch_4)
values_undirected_edges = Number(flatten(addition))
values_directed_edges = Number(flatten([branch_3, branch_4]))
log_2 = Logarithm(Value=values_undirected_edges)
bnd_2 = Bounds(Numbers=log_2)
remap_2 = RemapNumbers(Value=log_2, Source=bnd_2, Target=Domain(0, 1))  # -> Mapped, Clipped
gradient_2 = Gradient(
    LowerLimit=0,
    UpperLimit=1,
    Parameter=remap_2.Mapped,
    stops=[0: RGB(0, 0, 139), 0.328: RGB(50, 178, 206), 0.664: RGB(255, 215, 0), 1: RGB(255, 0, 0)])
directed_edges = Curve(c_move.A)
previewlw_5 = CustomPreviewLineweights(Geometry=undirectededges_2, Shader=gradient_2, Thickness=Slider(5, range=0..10), Absolute=False)

# ----
tag = TextTag(Location=eval.Point, Text=values_undirected_edges)

# ==== cluster SegmentLenght2Nodes
graph_edges = ClusterInput()
graph = ClusterInput()
graph_nodes = ClusterInput()
graph_2 = Data(graph)
graph_edges_2 = Line(graph_edges)
graph_nodes_2 = Point(graph_nodes)
branch = TreeBranch(Tree=graph_edges_2, Path="{0}", MaintainPaths=True)
lng = ListLength(List=branch)
lng_2 = ListLength(List=graph_nodes_2)
series = Series(Start=0, Step=1, Count=lng)
getnodesbyedge = GetNodesByEdge(Graph=graph_2, EdgeId=series)  # -> simplify(Nodes)
c_script = CSharpScript(NodeByEdgeIds=getnodesbyedge, NodeCount=lng_2)  # -> out, EdgebyNodeIds; inputs NodeByEdgeIds: tree of Int32, NodeCount: Int32
# ---------- c_script: C# ----------
    DataTree<int> Results = new DataTree<int>();
    for(int i = 0; i < NodeCount; i++)
      Results.EnsurePath(i);

    for(int i = 0; i < NodeByEdgeIds.BranchCount; i++)
    {
      List<int> tempIds = NodeByEdgeIds.Branch(i);
      foreach(int id in tempIds)
      {
        Results.Add(i, new GH_Path(id));
      }
    }

    EdgebyNodeIds = Results;
# ---------- end c_script ----------
item = ListItem(List=branch, Index=c_script.EdgebyNodeIds, Wrap=True)
len = Length(Curve=item)
division = Division(A=len, B=Slider(2, range=0..10))
ma = MassAddition(Input=division)  # -> flatten(Result), PartialResults
segment_length_based_node_weighting = Number(ma.Result)
segment_length_based_node_weighting_2 = ClusterOutput(segment_length_based_node_weighting)
